# Grasshopper definition ghe_sizing_with_gshp_energy_sim.gh (Grasshopper 1.0.7)
# plug-ins: Ironbug.Grasshopper

climatezones = HBClimateZones({"1 - Very Hot": "1", "2 - Hot": "2", "3 - Warm": "3", "4 - Mixed": "4", "5 - Cool": "5", "6 - Cold": "6", "7 - Very Cold": "7", "8 - Subarctic": "8"}, selected="5 - Cool")
constrsetclimate = HBConstructionSetByClimate(climate_zone=climatezones)  # -> constr_set; plug-in component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

mech = Geometry(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)
roomsolid = HBRoomFromSolid(geo=flatten(mech), constr_set=constrsetclimate, program="2019::SmallOffice::Elec/MechRoom", conditioned=Toggle(False))  # -> report, rooms; plug-in component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

restroom = Geometry([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])
roomsolid_2 = HBRoomFromSolid(geo=flatten(restroom), constr_set=constrsetclimate, program="2019::SmallOffice::Restroom", conditioned=True)  # -> report, rooms; plug-in component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

openoffice = Geometry([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])
roomsolid_3 = HBRoomFromSolid(geo=flatten(openoffice), constr_set=constrsetclimate, program="2019::SmallOffice::OpenOffice", conditioned=True)  # -> report, rooms; plug-in component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

corridor = Geometry([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])
roomsolid_4 = HBRoomFromSolid(geo=flatten(corridor), constr_set=constrsetclimate, program="2019::SmallOffice::Corridor", conditioned=True)  # -> report, rooms; plug-in component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

# ----
# Setup the Model
# Geometry and
# Programs
panel = Panel("2019::SmallOffice::Storage")
storage = Geometry([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])
roomsolid_5 = HBRoomFromSolid(geo=flatten(storage), constr_set=constrsetclimate, program=panel, conditioned=Toggle(False))  # -> report, rooms; plug-in component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

# ----
# Solve Adjacency
# and Add Windows
toggle = BooleanToggle(True)
windows = Geometry([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])
solveadj = HBSolveAdjacency(rooms=flatten([roomsolid_3.rooms, roomsolid_4.rooms, roomsolid.rooms, roomsolid_2.rooms, roomsolid_5.rooms]), run=toggle)  # -> report, adj_rooms; plug-in component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
aperture = HBAperture(geo=windows)  # -> report, apertures; plug-in component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
addsubface = HBAddSubface(hb_obj=flatten(solveadj.adj_rooms), sub_faces=flatten(aperture.apertures))  # -> report, hb_obj, unmatched; plug-in component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
doashvac = HBDOASHVAC(rooms=flatten(addsubface.hb_obj), system_type="DOAS_FCU_DCW_DHW", sensible_hr="0.8", latent_hr="0.75", dcv=Toggle(True))  # -> report, rooms; plug-in component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
model = HBModel(rooms=flatten(doashvac.rooms), name="sample_gshp")  # -> report, model; plug-in component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

# ----
# Set the Weather File
panel_2 = Panel("https://climate.onebuilding.org/WMO_Region_4_North_and_Central_America/USA_United_States_of_America/MA_Massachusetts/USA_MA_Boston-Logan.Intl.AP.725090_TMY3.zip")
downloadepw = LBDownloadWeather(weather_URL=panel_2)  # -> epw_file, stat_file, ddy_file; plug-in component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

simoutput = HBSimulationOutput(system_energy_use=Toggle(True))  # -> report, sim_output; plug-in component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
shadowcalc = HBShadowCalculation(calc_method="PixelCounting")  # -> shadow_calc; plug-in component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
simpar = HBSimulationParameter(output=simoutput.sim_output, timestep="1", shadow_calc=shadowcalc)  # -> sim_par; plug-in component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

# ----
# Run Initial Simulation
# to get the Building Loads
# 1
toggle_2 = BooleanToggle(False)
modeltoosm = HBModelToOSM(model=model.model, epw_file=downloadepw.epw_file, sim_par=simpar, write=toggle_2, run=toggle_2)  # -> report, jsons, osw, osm, idf, sql, zsz, rdd, html; plug-in component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
vizbytype = HBVisualizeByType(hb_objs=model.model)  # -> walls, interior_walls, roofs, ceilings, exterior_floors, interior_floors, air_walls, apertures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; plug-in component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

# ----
# Compute the Net Ground Load
# Compute the Net Building Load
roomenergyresult = HBReadRoomEnergyResult(sql=modeltoosm.sql)  # -> cooling, heating, lighting, electric_equip, gas_equip, process, hot_water, fan_electric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; plug-in component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
massarithop = LBMassArithmeticOperation(data=flatten(roomenergyresult.heating), type="Building Heating Load")  # -> data; plug-in component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
massarithop_2 = LBMassArithmeticOperation(data=flatten(roomenergyresult.cooling), type="Building Cooling Load")  # -> data; plug-in component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
arithop = LBArithmeticOperation(data_1=massarithop, data_2=massarithop_2, operator="-", type="Net Building Load")  # -> data; plug-in component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
rate = LBTimeRateOfChange(data=arithop)  # -> data_rate; plug-in component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
building_load = Data(rate)
python = GhPythonScript(building_load=building_load, cooling_cop="6.45", heating_cop="4")  # -> out, ground_load
# ---------- python: Python ----------
from ladybug_rhino.grasshopper import all_required_inputs

if all_required_inputs(ghenv.Component):
    ground_load = _building_load.duplicate()
    ground_load.header.metadata['type'] = 'Net Ground Load'
    load_values = []
    for val in _building_load.values:
        if val > 0:
            load_values.append(val - (val / _heating_cop))
        else:
            load_values.append(val + (val / _cooling_cop))
    ground_load.values = load_values
# ---------- end python ----------

# ----
# Visualize Loads
panel_3 = Panel("30000")
neg = Negative(Value=panel_3)
legendpar = LBLegendParameters(min=neg, max=panel_3, num_decimals="0")  # -> leg_par; plug-in component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
hourlyplot = LBHourlyPlot(data=[building_load, python.ground_load], base_pt="100, 0, 0", legend_par=legendpar)  # -> report, mesh, legend, borders, labels, title, vis_set; plug-in component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

# ----
# Size the Ground Heat Exchanger
importepw = LBImportEPW(epw_file=downloadepw.epw_file)  # -> location, dry_bulb_temperature, dew_point_temperature, relative_humidity, wind_speed, wind_direction, direct_normal_rad, diffuse_horizontal_rad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; plug-in component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
ground_load = Data(python.ground_load)
xdata = LBDeconstructData(data=importepw.dry_bulb_temperature)  # -> header, values; plug-in component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
avr = Average(Input=xdata.values)
gheborehole = DFGHEBoreholeParameter(
    min_spacing=Slider(5, range=0..15),
    max_spacing=Slider(36, range=5..50),
    min_depth=Slider(40, range=40..60),
    max_depth=Slider(100, range=50..150))  # -> borehole; plug-in component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
ghesoil = DFGHESoilParameter(temperature=avr)  # -> soil; plug-in component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
# 2
toggle_3 = BooleanToggle(False)
site_geometry = Geometry(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)
ghedesigner = DFGHEDesigner(load=ground_load, site=site_geometry, borehole=gheborehole, soil=ghesoil, write=toggle_3, run=toggle_3)  # -> report, input_json, boreholes, bore_geo, g_function, properties, month_temps; plug-in component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

deconstructmodel = HBDeconstructModel(model=model.model)  # -> rooms, faces, apertures, doors, shades; plug-in component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
panel_4 = Panel(ghedesigner.report)

# ----
# Properties of the GHE from the Sizing Simulation
bang = ExplodeTree(Data=simplify(graft(ghedesigner.properties)))  # -> Branch0, Branch1, Branch2, Branch3, Branch4, Branch5, Branch6, Branch7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
g_function = Data(flatten(ghedesigner.g_function))
objparams = IB_ObjParams(
    BoreHoleLength=bang.Branch0,
    BoreHoleRadius=bang.Branch1,
    DesignFlowRate=bang.Branch2,
    GroundTemperature=bang.Branch3,
    GroundThermalConductivity=bang.Branch4,
    GroundThermalHeatCapacity=bang.Branch5,
    GroutThermalConductivity=bang.Branch6,
    NumberofBoreHoles=bang.Branch7,
    PipeOutDiameter=bang.Branch8,
    PipeThermalConductivity=bang.Branch9,
    PipeThickness=bang.Branch10,
    UTubeDistance=bang.Branch11,
    DataFieldSetType="Ironbug.HVAC.IB_GroundHeatExchangerVertical_FieldSet")
groundhxvertical = Ironbug_GroundHeatExchangerVertical(GFunctions=g_function, Parameters_=objparams, dupNum=False)

simoutput_2 = HBSimulationOutput(system_energy_use=Toggle(True))  # -> report, sim_output; plug-in component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
shadowcalc_2 = HBShadowCalculation(calc_method="PixelCounting")  # -> shadow_calc; plug-in component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
simpar_2 = HBSimulationParameter(output=simoutput_2.sim_output, timestep=6, shadow_calc=shadowcalc_2)  # -> sim_par; plug-in component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

# ----
# Run Final Energy Simulation
# to Determine Energy Use
# 3
toggle_4 = BooleanToggle(False)

# ----
# Zone Equipment
heating_cop = Data("4")
cooling_cop = Data("6.45")
objparams_2 = IB_ObjParams(
    RatedCoolingCoefficientofPerformance=cooling_cop,
    DataFieldSetType="Ironbug.HVAC.IB_CoilCoolingWaterToAirHeatPumpEquationFit_FieldSet")
objparams_3 = IB_ObjParams(
    RatedHeatingCoefficientofPerformance=heating_cop,
    DataFieldSetType="Ironbug.HVAC.IB_CoilHeatingWaterToAirHeatPumpEquationFit_FieldSet")
objparams_4 = IB_ObjParams(FanEfficiency="0.75", MotorEfficiency="0.9", PressureRise="430", DataFieldSetType="Ironbug.HVAC.IB_FanOnOff_FieldSet")
coilhtn_watertoair = Ironbug_CoilCoolingWaterToAirHeatPumpEquationFit(Parameters_=objparams_2, dupNum=False)  # -> CoilCoolingWaterToAirHeatPumpEquationFit, ToWaterLoop
coilhtn_watertoair_2 = Ironbug_CoilHeatingWaterToAirHeatPumpEquationFit(Parameters_=objparams_3, dupNum=False)  # -> CoilHeatingWaterToAirHeatPumpEquationFit, ToWaterLoop
fanonoff = Ironbug_FanOnOff(Parameters_=objparams_4, dupNum=False)
objparams_5 = IB_ObjParams(
    OutdoorAirFlowRateDuringCoolingOperation="0",
    OutdoorAirFlowRateDuringHeatingOperation="0",
    OutdoorAirFlowRateWhenNoCoolingorHeatingisNeeded="0",
    SupplyAirFlowRateWhenNoCoolingorHeatingisNeeded="0",
    DataFieldSetType="Ironbug.HVAC.IB_ZoneHVACWaterToAirHeatPump_FieldSet")
vavnoreheat = Ironbug_AirTerminalSingleDuctVAVNoReheat(dupNum=False)

# ----
# Rooms
roomenergyattr = HBRoomEnergyAttributes({"Program": "properties.energy.program_type.display_name", "Construction Set": "properties.energy.construction_set.display_name", "Is Conditioned": "properties.energy.is_conditioned", "People per Area [ppl/m2]": "properties.energy.people.people_per_area", "Area per Person [m2/ppl]": "properties.energy.people.area_per_person", "Lighting per Area [W/m2]": "properties.energy.lighting.watts_per_area"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}, selected="Is Conditioned")
rooms = Data(flatten(deconstructmodel.rooms))

roomsbyattr = HBRoomsByAttribute(rooms=flatten(rooms), attribute=roomenergyattr)  # -> values, rooms; plug-in component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

bang_2 = ExplodeTree(Data=roomsbyattr.rooms)  # -> Branch0, Branch1

lng = ListLength(List=bang_2.Branch1)
duplicate = Ironbug_Duplicate(Reference=coilhtn_watertoair_2.CoilHeatingWaterToAirHeatPumpEquationFit, Amount=lng)  # -> Objects, graft(ToWaterLoop)
duplicate_2 = Ironbug_Duplicate(Reference=coilhtn_watertoair.CoilCoolingWaterToAirHeatPumpEquationFit, Amount=lng)  # -> Objects, graft(ToWaterLoop)
duplicate_3 = Ironbug_Duplicate(Reference=fanonoff, Amount=lng)  # -> Objects, graft(port)
waterairheatpump = Ironbug_ZoneHVACWaterToAirHeatPump(
    HeatingCoil=duplicate.Objects,
    CoolingCoil=duplicate_2.Objects,
    Fan_=duplicate_3.Objects,
    Parameters_=objparams_5,
    dupNum=False)
duplicate_4 = Ironbug_Duplicate(Reference=vavnoreheat, Amount=lng)  # -> Objects, graft(port)
thermalzone = Ironbug_ThermalZone(
    HoneybeeZonesOrOsZones=bang_2.Branch1,
    AirTerminal_=duplicate_4.Objects,
    ZoneEquipment=waterairheatpump,
    IsAirTerminalPriorToZoneEquipments=True,
    allowMultiAirloops=False,
    dupNum=False)

# ----
# DOAS
latent_recovery = Data("0.75")
sensible_recovery = Data("0.8")
objparams_6 = IB_ObjParams(
    LatentEffectivenessat100CoolingAirFlow=latent_recovery,
    LatentEffectivenessat100HeatingAirFlow=latent_recovery,
    LatentEffectivenessat75CoolingAirFlow=latent_recovery,
    LatentEffectivenessat75HeatingAirFlow=latent_recovery,
    SensibleEffectivenessat100CoolingAirFlow=sensible_recovery,
    SensibleEffectivenessat100HeatingAirFlow=sensible_recovery,
    SensibleEffectivenessat75CoolingAirFlow=sensible_recovery,
    SensibleEffectivenessat75HeatingAirFlow=sensible_recovery,
    DataFieldSetType="Ironbug.HVAC.IB_HeatExchangerAirToAirSensibleAndLatent_FieldSet")
objparams_7 = IB_ObjParams(DemandControlledVentilation=Toggle(True), DataFieldSetType="Ironbug.HVAC.IB_ControllerMechanicalVentilation_FieldSet")
airloopbranches = AirLoopBranches(Branch1=thermalzone)
mechventcontroller = IB_ControllerMechanicalVentilation(Parameters_=objparams_7, dupNum=False)
spm_oareset = IB_SetpointManagerOutdoorAirReset(
    SetpointatOutdoorHighTemperature="15.5",
    OutdoorHighTemperature="21.1",
    SetpointatOutdoorLowTemperature="21.1",
    OutdoorLowTemperature="12.8",
    dupNum=False)
oacontroller = IB_OAController(ControllerMechanicalVentilation=mechventcontroller, dupNum=False)
coilclndx1 = Ironbug_CoilCoolingDXSingleSpeed(dupNum=False)
fanvariable = Ironbug_FanVariableVolume(dupNum=False)
coilhtnelec = IB_CoilHeatingElectric(dupNum=False)
objparams_8 = IB_ObjParams(TypeofLoadtoSizeOn="VentilationRequirement", DataFieldSetType="Ironbug.HVAC.IB_SizingSystem_FieldSet")
heatexchanger_air = IB_HeatExchangerAirToAirSensibleAndLatent(Parameters_=objparams_6, dupNum=False)
objparams_9 = IB_ObjParams(Name="DOAS", DataFieldSetType="Ironbug.HVAC.IB_AirLoopHVAC_FieldSet")
oasystem = Ironbug_OutdoorAirSystem(HeatRecovery_=heatexchanger_air, Controller_=oacontroller)
sizingsystem = Ironbug_SizingSystem(Parameters_=objparams_8, dupNum=False)
merge = Merge(Data1=oasystem, Data2=coilclndx1, Data3=coilhtnelec, Data4=fanvariable, Data5=spm_oareset)
airloop = Ironbug_AirLoopHVAC(Supply=merge, Demand=airloopbranches, SizingSystem=sizingsystem, Parameters_=objparams_9, dupNum=False)

# ----
# Heat Pump Loop
pipeadiabatic = Ironbug_PipeAdiabatic(dupNum=False)
pipeadiabatic_2 = Ironbug_PipeAdiabatic(dupNum=False)
pumpvariable = Ironbug_PumpVariableSpeed(dupNum=False)
plantbranches = PlantBranches(Branch1=groundhxvertical, Branch=pipeadiabatic, mapBranchToLoop=False)
spm_scheduled = Ironbug_SetpointManagerScheduled(Temperature="21.1", dupNum=False)
objparams_10 = IB_ObjParams(Name="Heat Pump Loop", DataFieldSetType="Ironbug.HVAC.IB_PlantLoop_FieldSet")
plantbranches_2 = PlantBranches(B1=duplicate.ToWaterLoop, B2=duplicate_2.ToWaterLoop, B3=pipeadiabatic_2, mapBranchToLoop=False)
merge_2 = Merge(Data1=pumpvariable, Data2=plantbranches, Data3=spm_scheduled)
condenserwaterloop = Ironbug_CondenserWaterPlantLoop(Supply=merge_2, Demand=plantbranches_2, Parameters_=objparams_10, dupNum=False)

hvacsystem = Ironbug_HVACSystem(AirLoops=flatten(airloop), PlantLoops=flatten(condenserwaterloop))

detailedhvac = HBDetailedHVAC(hb_objs=flatten(rooms), hvac_system=hvacsystem)  # -> report, hb_objs; plug-in component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
model_2 = HBModel(rooms=flatten(detailedhvac.hb_objs))  # -> report, model; plug-in component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

modeltoosm_2 = HBModelToOSM(model=model_2.model, epw_file=downloadepw.epw_file, sim_par=simpar_2, write=toggle_4, run=toggle_4)  # -> report, jsons, osw, osm, idf, sql, zsz, rdd, html; plug-in component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

eui = HBEndUseIntensity(sql=modeltoosm_2.sql)  # -> eui, eui_end_use, end_uses, gross_floor; plug-in component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
panel_5 = Panel(eui.eui_end_use)
end_use_intensity_kwh_m2 = Panel(eui.eui)
panel_6 = Panel(eui.end_uses)
