# Grasshopper definition load_sharing_example.gh (Grasshopper 1.0.7)

# ----
# Full Bldg Small Office ProgramType
panel = Panel("""2013::LargeOffice::ClosedOffice
2013::LargeOffice::Conference
2013::LargeOffice::Corridor
2013::LargeOffice::OpenOffice
2013::LargeOffice::Restroom
2013::LargeOffice::Storage""")
panel_2 = Panel("""0.15
0.15
0.2
0.4
0.05
0.05""")
blendprograms = HBBlendProgramTypes(name="LargeOfficeBuilding", programs=panel, ratios=panel_2)  # -> program; plug-in component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

# ----
# Construction Set
bldg_vintage = Dragonfly_BldgAge({"ASHRAE 90.1 2013  |  IECC 2015": "2013", "ASHRAE 90.1 2010  |  IECC 2012": "2010", "ASHRAE 90.1 2007  |  IECC 2009": "2007", "ASHRAE 90.1 2004  |  IECC 2006": "2004", "1980-2004 (CBECS)": "1980_2004", "Pre-1980 (CBECS)": "pre_1980"}, selected="ASHRAE 90.1 2013  |  IECC 2015")
constr_type = Dragonfly_BldgAge({"SteelFramed", "WoodFramed", "Mass", "Metal Building"}, selected="SteelFramed")
climate_zone = Dragonfly_BldgAge({"1 - Very Hot": "1", "2 - Hot": "2", "3 - Warm": "3", "4 - Mixed": "4", "5 - Cool": "5", "6 - Cold": "6", "7 - Very Cold": "7", "8 - Subarctic": "8"}, selected="5 - Cool")
constrsetclimate = HBConstructionSetByClimate(climate_zone=climate_zone, vintage=bldg_vintage, constr_type=constr_type)  # -> constr_set; plug-in component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

# ----
# Create Office Buildings
panel_3 = Panel("OfficeBldg")
officesolids = Geometry([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])
panel_4 = Panel("""1@5
2@4
@3""")
buildingsolid = DFBuildingFromSolid(
    bldg_geo=flatten(officesolids),
    floor_to_floor=panel_4,
    name=panel_3,
    program=blendprograms,
    constr_set=constrsetclimate,
    run=Toggle(True))  # -> report, buildings; plug-in component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
decnstrdf = DFDeconstructObject(df_obj=buildingsolid.buildings)  # -> stories, room2ds; plug-in component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

wires = BrepWireframe(Brep=officesolids, Density=-1)
panel_5 = Panel("""@4
@3""")

# ----
# Create Residential Buildings
panel_6 = Panel("2013::MidriseApartment::Apartment")
residentialsolids = Geometry([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])
buildingsolid_2 = DFBuildingFromSolid(
    bldg_geo=flatten(residentialsolids),
    floor_to_floor=panel_5,
    name="ResidentialBldg",
    program=panel_6,
    constr_set=constrsetclimate,
    run=Toggle(True))  # -> report, buildings; plug-in component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
simpleratiopar = DFSimpleWindowRatioParameters(ratio="0.25")  # -> win_par; plug-in component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
applyfacadepar = DFApplyFacadeParameters(df_obj=flatten(buildingsolid_2.buildings), win_par=simpleratiopar)  # -> report, df_obj; plug-in component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

wires_2 = BrepWireframe(Brep=residentialsolids, Density=-1)

# ---- group: properties for ground floor retail
item = ListItem(List=decnstrdf.stories, Index="0", Wrap=True)
reassignprop = DFReassignEnergyProperties(df_obj=item, program="2013::Retail::Retail")  # -> df_obj; plug-in component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
overhangpar = DFOverhangParameters(depth="4", angle="10")  # -> shd_par; plug-in component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
simpleratiopar_2 = DFSimpleWindowRatioParameters(ratio="0.65")  # -> win_par; plug-in component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
applyfacadepar_2 = DFApplyFacadeParameters(df_obj=reassignprop, win_par=simpleratiopar_2, shd_par=overhangpar)  # -> report, df_obj; plug-in component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

# ---- group: properties for above-ground office
cull_i = CullIndex(List=decnstrdf.stories, Indices="0", Wrap=True)
simpleratiopar_3 = DFSimpleWindowRatioParameters(ratio="0.4")  # -> win_par; plug-in component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
applyfacadepar_3 = DFApplyFacadeParameters(df_obj=cull_i, win_par=simpleratiopar_3)  # -> report, df_obj; plug-in component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

# ----
txt = Text(buildingsolid.buildings)
split = TextSplit(Text=txt, Separators=":")
item_2 = ListItem(List=split, Index="-1", Wrap=True)  # -> simplify(Item)

stories = Data(simplify(applyfacadepar_3.df_obj))
stories_2 = Data(simplify(applyfacadepar_2.df_obj))
stories_3 = Data(simplify([stories, stories_2]))
buildingstories = DFBuildingFromStories(stories=stories_3, name=item_2, constr_set=constrsetclimate)  # -> report, building; plug-in component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
commercialbldgs = Data(flatten(buildingstories.building))

# ---- group: Remove Economizer to See the Maximal Load Overlap
all_buildings = Data(flatten([commercialbldgs, applyfacadepar.df_obj]))
dfidealair = DFIdealAir(df_objs=flatten(all_buildings), economizer="NoEconomizer")  # -> report, df_objs; plug-in component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

# ----
# Create Dragonfly and
# Honeybee Models
panel_7 = Panel("ParkingStructure")
contextshade = Geometry([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])
context = DFContextShade(geo=contextshade, name=panel_7)  # -> report, context; plug-in component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
model = DFModel(buildings=flatten(dfidealair.df_objs), context=flatten(context.context), name="Mass Pike District")  # -> report, model; plug-in component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
# 1
# Translate Models
# to Honeybee
toggle = BooleanToggle(False)
tohoneybee = DFModelToHoneybee(model=model.model, use_multiplier=Toggle(False), shade_dist="50", run=toggle)  # -> report, hb_models; plug-in component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

# ----
# Download EPW File
panel_8 = Panel("https://energyplus-weather.s3.amazonaws.com/north_and_central_america_wmo_region_4/USA/MA/USA_MA_Boston-Logan.Intl.AP.725090_TMY3/USA_MA_Boston-Logan.Intl.AP.725090_TMY3.zip")
downloadepw = LBDownloadWeather(weather_URL=panel_8)  # -> epw_file, stat_file, ddy_file; plug-in component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

# ----
# Simulation Parameters
panel_9 = Panel("""Zone Ideal Loads Supply Air Total Cooling Energy
Zone Ideal Loads Supply Air Total Heating Energy
Water Use Equipment Heating Energy""")
customoutput = HBCustomSimulationOutput(output_names=panel_9, report_frequency="timestep")  # -> report, sim_output; plug-in component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
analysisperiod = LBAnalysisPeriod(start_month="7", start_day=1, start_hour=0, end_month="7")  # -> period, hoys, dates; plug-in component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
simpar = HBSimulationParameter(output=customoutput.sim_output, run_period=analysisperiod.period, timestep=6)  # -> sim_par; plug-in component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

directory_into_which_files_will_be_writt = Panel("C:\district_model_load_sharing")  # "Directory into which files will be written"

# ----
# Export to OpenStudio
# 2
# Export
# OSW Files
toggle_2 = BooleanToggle(False)
modeltoosm = HBModelToOSM(
    model=tohoneybee.hb_models,
    epw_file=downloadepw.epw_file,
    sim_par=simpar,
    folder=directory_into_which_files_will_be_writt,
    write=toggle_2)  # -> report, jsons, osw, osm, idf, sql, zsz, rdd, html; plug-in component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

# ----
# Run Simulations
# 3
# Translate
# OSW to OSM
toggle_3 = BooleanToggle(False)
runosw = HBRunOSW(osw=modeltoosm.osw, epw_file=downloadepw.epw_file, translate=toggle_3, run=toggle_3)  # -> report, osm, idf, sql, zsz, rdd, html; plug-in component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

# ----
# Cooling Load
panel_10 = Panel("""Zone Ideal Loads Supply Air Total Heating Energy
Water Use Equipment Heating Energy""")
customresult = HBReadCustomResult(sql=runosw.sql, output_names=panel_10)  # -> results; plug-in component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
massarithop = LBMassArithmeticOperation(data=flatten(customresult), type="District Heating Demand")  # -> data; plug-in component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
colrange = LBColorRange(index="16")  # -> colors; plug-in component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
legendpar = LBLegendParameters(min="0", max="1000", colors=colrange, num_decimals="0")  # -> leg_par; plug-in component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
hourlyplot = LBHourlyPlot(data=massarithop, base_pt="700,0,0", x_dim="4", y_dim="1", legend_par=legendpar)  # -> report, mesh, legend, borders, labels, title; plug-in component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
item_3 = ListItem(List=hourlyplot.legend, Index=0, Wrap=True)
medges = MeshEdges(Mesh=item_3)  # -> NakedEdges, InteriorEdges, NonManifoldEdges

# ----
# Heating Load
panel_11 = Panel("Zone Ideal Loads Supply Air Total Cooling Energy")
customresult_2 = HBReadCustomResult(sql=runosw.sql, output_names=panel_11)  # -> results; plug-in component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
massarithop_2 = LBMassArithmeticOperation(data=flatten(customresult_2), type="District Cooling Demand")  # -> data; plug-in component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
colrange_2 = LBColorRange(index="17")  # -> colors; plug-in component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
legendpar_2 = LBLegendParameters(min="0", max="1000", colors=colrange_2, num_decimals="0")  # -> leg_par; plug-in component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
hourlyplot_2 = LBHourlyPlot(data=massarithop_2, base_pt="500,0,0", x_dim="4", y_dim="1", legend_par=legendpar_2)  # -> report, mesh, legend, borders, labels, title; plug-in component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
item_4 = ListItem(List=hourlyplot_2.legend, Index=0, Wrap=True)
medges_2 = MeshEdges(Mesh=item_4)  # -> NakedEdges, InteriorEdges, NonManifoldEdges

# ----
# Overlap Load
python = GhPythonScript(cooling=massarithop_2, heating=massarithop)  # -> overlap
# ---------- python: Python ----------
from ladybug.datatype.energy import Energy
from ladybug.header import Header
from ladybug.datacollection import HourlyContinuousCollection


if _cooling and _heating:
    overlap_vals = []
    for cool, heat in zip(_cooling.values, _heating.values):
        if cool < heat:
            overlap_vals.append(cool)
        else:
            overlap_vals.append(heat)
    head = Header(Energy(), 'kWh', _cooling.header.analysis_period,
                  {'type': 'Distric Thermal Overlap'})
    overlap = HourlyContinuousCollection(head, overlap_vals)
# ---------- end python ----------
legendpar_3 = LBLegendParameters(
    min="0",
    max="1000",
    colors=[ColourSwatch(SwatchColor=RGB(255, 255, 255)), ColourSwatch(SwatchColor=RGB(0, 217, 25)), ColourSwatch(SwatchColor=RGB(12, 145, 0))],
    num_decimals="0")  # -> leg_par; plug-in component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

hourlyplot_3 = LBHourlyPlot(data=python, base_pt="900,0,0", x_dim="4", y_dim="1", legend_par=legendpar_3)  # -> report, mesh, legend, borders, labels, title; plug-in component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

item_5 = ListItem(List=hourlyplot_3.legend, Index=0, Wrap=True)
medges_3 = MeshEdges(Mesh=item_5)  # -> NakedEdges, InteriorEdges, NonManifoldEdges
