# Grasshopper definition open_dss_example.gh (Grasshopper 1.0.7)

# ----
# Create Blended Building Programs
panel = Panel("""2013::Retail::Retail
2013::SmallOffice::ClosedOffice
2013::SmallOffice::Conference
2013::SmallOffice::Corridor
2013::SmallOffice::OpenOffice""")
panel_2 = Panel("""0.4
0.1
0.05
0.2
0.25""")
bldgprograms = HBBuildingPrograms({"LargeOffice", "MediumOffice", "SmallOffice", "MidriseApartment", "HighriseApartment", "Retail", "StripMall", "PrimarySchool", "SecondarySchool", "SmallHotel", "LargeHotel", "Hospital", "Outpatient", "Laboratory", "Warehouse", "SuperMarket", "FullServiceRestaurant", "QuickServiceRestaurant", "Courthouse", "LargeDataCenterHighITE", "LargeDataCenterLowITE", "SmallDataCenterHighITE", "SmallDataCenterLowITE"}, selected="Outpatient")
bldgprograms_2 = HBBuildingPrograms({"LargeOffice", "MediumOffice", "SmallOffice", "MidriseApartment", "HighriseApartment", "Retail", "StripMall", "PrimarySchool", "SecondarySchool", "SmallHotel", "LargeHotel", "Hospital", "Outpatient", "Laboratory", "Warehouse", "SuperMarket", "FullServiceRestaurant", "QuickServiceRestaurant", "Courthouse", "LargeDataCenterHighITE", "LargeDataCenterLowITE", "SmallDataCenterHighITE", "SmallDataCenterLowITE"}, selected="FullServiceRestaurant")
bldgprograms_3 = HBBuildingPrograms({"LargeOffice", "MediumOffice", "SmallOffice", "MidriseApartment", "HighriseApartment", "Retail", "StripMall", "PrimarySchool", "SecondarySchool", "SmallHotel", "LargeHotel", "Hospital", "Outpatient", "Laboratory", "Warehouse", "SuperMarket", "FullServiceRestaurant", "QuickServiceRestaurant", "Courthouse", "LargeDataCenterHighITE", "LargeDataCenterLowITE", "SmallDataCenterHighITE", "SmallDataCenterLowITE"}, selected="MidriseApartment")
bldgprograms_4 = HBBuildingPrograms({"LargeOffice", "MediumOffice", "SmallOffice", "MidriseApartment", "HighriseApartment", "Retail", "StripMall", "PrimarySchool", "SecondarySchool", "SmallHotel", "LargeHotel", "Hospital", "Outpatient", "Laboratory", "Warehouse", "SuperMarket", "FullServiceRestaurant", "QuickServiceRestaurant", "Courthouse", "LargeDataCenterHighITE", "LargeDataCenterLowITE", "SmallDataCenterHighITE", "SmallDataCenterLowITE"}, selected="StripMall")
bldgprograms_5 = HBBuildingPrograms({"LargeOffice", "MediumOffice", "SmallOffice", "MidriseApartment", "HighriseApartment", "Retail", "StripMall", "PrimarySchool", "SecondarySchool", "SmallHotel", "LargeHotel", "Hospital", "Outpatient", "Laboratory", "Warehouse", "SuperMarket", "FullServiceRestaurant", "QuickServiceRestaurant", "Courthouse", "LargeDataCenterHighITE", "LargeDataCenterLowITE", "SmallDataCenterHighITE", "SmallDataCenterLowITE"}, selected="MediumOffice")
blendprograms = HBBlendProgramTypes(name="Mixed Use Building Program", programs=panel, ratios=panel_2)  # -> program; plug-in component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

# ----
# Construction Set
bldg_vintage = Dragonfly_BldgAge({"ASHRAE 90.1 2013  |  IECC 2015": "2013", "ASHRAE 90.1 2010  |  IECC 2012": "2010", "ASHRAE 90.1 2007  |  IECC 2009": "2007", "ASHRAE 90.1 2004  |  IECC 2006": "2004", "1980-2004 (CBECS)": "1980_2004", "Pre-1980 (CBECS)": "pre_1980"}, selected="ASHRAE 90.1 2013  |  IECC 2015")
constr_type = Dragonfly_BldgAge({"SteelFramed", "WoodFramed", "Mass", "Metal Building"}, selected="SteelFramed")
climate_zone = Dragonfly_BldgAge({"1 - Very Hot": "1", "2 - Hot": "2", "3 - Warm": "3", "4 - Mixed": "4", "5 - Cool": "5", "6 - Cold": "6", "7 - Very Cold": "7", "8 - Subarctic": "8"}, selected="5 - Cool")
constrsetclimate = HBConstructionSetByClimate(climate_zone=climate_zone, vintage=bldg_vintage, constr_type=constr_type)  # -> constr_set; plug-in component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
data = Data(constrsetclimate)

# ----
# Basic Building Properties
building_names = Panel("""Mixed_use 1
Restaurant 1
Residential 1
Residential 2
Residential 4
Residential 5
Office 1
Hospital 1
Hospital 2
Mixed use 2
Residential 3
Mall 1
Residential 6""")
floor_to_floor_m = Panel("3.5")
number_of_stories = Panel("""4
1
3
3
1
1
6
10
3
8
3
3
10""")
footprints = Geometry(simplify(graft([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])))
perimeter_depth_m = Panel("10")
dup = DuplicateData(Data=floor_to_floor_m, Number=number_of_stories, Order=True)  # -> simplify(Data)
data_2 = Data(simplify(graft(building_names)))

# ----
# Order Programs
# to Match Footprints
merge = Merge(
    Data1=blendprograms,
    Data2=bldgprograms_2,
    Data3=bldgprograms_3,
    Data4=bldgprograms_3,
    Data5=bldgprograms_3,
    Data6=bldgprograms_3,
    Data7=bldgprograms_5,
    Data8=bldgprograms,
    Data9=bldgprograms,
    Data10=blendprograms,
    Data11=bldgprograms_3,
    Data12=bldgprograms_4,
    Data13=bldgprograms_3)  # -> simplify(graft(Result))

# ----
# Create Buildings
buildingfootprint = DFBuildingFromFootprint(
    footprint_geo=footprints,
    floor_to_floor=dup,
    perim_offset=perimeter_depth_m,
    name=data_2,
    program=merge,
    constr_set=data,
    run=Toggle(True))  # -> report, buildings; plug-in component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
topbottom = DFSeparateTopBottom(buildings=buildingfootprint.buildings)  # -> simplify(buildings); plug-in component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

# ----
# Assign Windows
window_ratios_per_building = Panel("""0.2
0.35
0.3
0.3
0.3
0.3
0.7
0.6
0.6
0.35
0.3
0.25
0.4""")
simpleratiopar = DFSimpleWindowRatioParameters(ratio=window_ratios_per_building)  # -> simplify(graft(win_par)); plug-in component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
applyfacadepar = DFApplyFacadeParameters(df_obj=topbottom, win_par=simpleratiopar)  # -> report, df_obj; plug-in component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

# ----
# Search Transformers + Wires
searchopendss = DFSearchOpenDSS()  # -> transformers, wires; plug-in component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
panel_3 = Panel(searchopendss.wires)
panel_4 = Panel(searchopendss.transformers)

# ----
# Assign HVAC
hvac_templates = Panel("""VAV_Chiller_Boiler
VAV_Chiller_Boiler
PTAC_BoilerBaseboard
PTAC_BoilerBaseboard
PTAC_BoilerBaseboard
PTAC_BoilerBaseboard
VAV_Chiller_Boiler
VAV_Chiller_Boiler
VAV_Chiller_Boiler
VAV_Chiller_Boiler
PTAC_BoilerBaseboard
VAV_Chiller_Boiler
PTAC_BoilerBaseboard""")
data_3 = Data(simplify(graft(hvac_templates)))
dfallairhvac = DFAllAirHVAC(df_objs=applyfacadepar.df_obj, system_type=data_3)  # -> report, df_objs; plug-in component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

# ----
# Transformers + Substation
transformer_properties = Panel("""Transformer--100KVA PM
Transformer--50KVA PM
Transformer--50KVA CT
Transformer--75KVA CT
Transformer--75KVA PM""")
transformers = Geometry([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])
substation = Geometry(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)
transformer = DFTransformer(geo=transformers, properties=transformer_properties)  # -> transformer; plug-in component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
substation_2 = DFSubstation(geo=substation)  # -> substation; plug-in component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

# ----
# Electric Connectors
wires_type_6 = Panel("""UG TPLX 2/0 C
UG TPLX 2/0 B
UG TPLX 2/0 A""")
wires_type_2 = Panel("""OH AL 1/0 A
OH AL 1/0 B
OH AL 1/0 C
OH AL 1/0 N""")
wires_type_3 = Panel("""UG TPLX 1/0 A
UG TPLX 1/0 B
UG TPLX 1/0 C""")
wires_type_4 = Panel("""OH TPLX 2/0 S2
OH TPLX 2/0 N
OH TPLX 2/0 S1""")
wires_type_5 = Panel("""OH TPLX 2/0 S1
OH TPLX 2/0 S2
OH TPLX 2/0 N""")
wires_type_1 = Panel("""OH AL 2/0 A
OH AL 2/0 B
OH AL 2/0 C
OH AL 2/0 N""")
wires_type_2_2 = Geometry([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])
wires_type_3_2 = Geometry([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])
wires_type_4_2 = Geometry([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])
wires_type_5_2 = Geometry([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])
wires_type_1_2 = Geometry([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])
wires_type_6_2 = Geometry(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)
connector = DFElectricalConnector(geo=wires_type_1_2, wires=wires_type_1)  # -> connector; plug-in component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
connector_2 = DFElectricalConnector(geo=wires_type_2_2, wires=wires_type_2)  # -> connector; plug-in component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
connector_3 = DFElectricalConnector(geo=wires_type_3_2, wires=wires_type_3)  # -> connector; plug-in component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
connector_4 = DFElectricalConnector(geo=wires_type_4_2, wires=wires_type_4)  # -> connector; plug-in component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
connector_5 = DFElectricalConnector(geo=wires_type_5_2, wires=wires_type_5)  # -> connector; plug-in component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
connector_6 = DFElectricalConnector(geo=wires_type_6_2, wires=wires_type_6)  # -> connector; plug-in component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

# ----
# Create Model
panel_5 = Panel("Buffalo New Development GEB")
model = DFModel(buildings=flatten(dfallairhvac.df_objs), name=panel_5)  # -> report, model; plug-in component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

# ----
# Create Electric
# Infrastructure
network = DFElectricalNetwork(
    substation=substation_2,
    transformers=flatten(transformer),
    connectors=flatten([connector, connector_2, connector_3, connector_4, connector_5, connector_6]))  # -> report, network; plug-in component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

# ----
# Visualize Model Properties
room2dattr = DFRoom2DAttributes({"Display Name": "display_name", "Simulation Name (Identifier)": "identifier", "Floor-To-Ceiling Height": "floor_to_ceiling_height", "Floor Elevation": "floor_height", "Ceiling Elevation": "ceiling_height", "Is Ground Contact": "is_ground_contact"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}, selected="Program": "properties.energy.program_type.display_name")
data_4 = Data(flatten(model.model))
colorroom2dattr = DFColorRoom2DAttributes(df_obj=flatten(data_4), attribute=room2dattr)  # -> mesh, legend, wire_frame, values, colors; plug-in component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

# ----
# Download EPW File
panel_6 = Panel("https://energyplus-weather.s3.amazonaws.com/north_and_central_america_wmo_region_4/USA/NY/USA_NY_Buffalo-Greater.Buffalo.Intl.AP.725280_TMY/USA_NY_Buffalo-Greater.Buffalo.Intl.AP.725280_TMY.zip")
analysisperiod = LBAnalysisPeriod(start_month="8", start_day=1, start_hour=0, end_month="8")  # -> period, hoys, dates; plug-in component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
downloadepw = LBDownloadWeather(weather_URL=panel_6)  # -> epw_file, stat_file, ddy_file; plug-in component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
simpar = HBSimulationParameter(run_period=analysisperiod.period, timestep="1")  # -> sim_par; plug-in component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

# ----
# Write geoJSON
panel_7 = Panel("-78.852466")
constrloc = LBConstructLocation(name="Buffalo, NY", latitude="42.813153", longitude=panel_7, time_zone="-5", elevation="200")  # -> location; plug-in component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
pt = Point(Point(0, 0, 0))
togeojson = DFModelToGeoJSON(
    model=model.model,
    location=constrloc,
    point=pt,
    use_multiplier=Toggle(False),
    shade_dist="50",
    elec_network=network.network,
    write=Toggle(False))  # -> report, geojson, hb_jsons, hb_models; plug-in component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

# ----
# Run Simulation
runurbanopt = DFRunURBANopt(geojson=togeojson.geojson, epw_file=downloadepw.epw_file, sim_par=simpar, run=Toggle(False))  # -> report, scenario, osm, idf, sql, zsz, rdd, html; plug-in component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

# ----
# Compute EUI
# (just over run period)
toggle = BooleanToggle(True)
eui = HBEndUseIntensity(sql=runurbanopt.sql, ip=toggle)  # -> eui, eui_end_use, end_uses, gross_floor; plug-in component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
eui_kbtu_ft2 = Panel(eui.eui)
panel_8 = Panel(eui.eui_end_use)
panel_9 = Panel(eui.end_uses)

# ----
# Run OpenDSS
runopendss = DFRunOpenDSS(geojson=togeojson.geojson, scenario=runurbanopt.scenario, run=Toggle(False))  # -> report, buildings, connectors, transformers; plug-in component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

# ----
# Visualize Results
opendssresult = DFReadOpenDSSResult(dss_csv=runopendss.transformers)  # -> factors, condition; plug-in component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
hourlyplot = LBHourlyPlot(data=opendssresult.condition, base_pt="0,-150,0", x_dim="4")  # -> report, mesh, legend, borders, labels, title; plug-in component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
