# Grasshopper definition uwg_example.gh (Grasshopper 1.0.7)

# ----
# Parking Buildings
bldgprograms = HBBuildingPrograms({"LargeOffice", "MediumOffice", "SmallOffice", "MidriseApartment", "HighriseApartment", "Retail", "StripMall", "PrimarySchool", "SecondarySchool", "SmallHotel", "LargeHotel", "Hospital", "Outpatient", "Laboratory", "Warehouse", "SuperMarket", "FullServiceRestaurant", "QuickServiceRestaurant", "Courthouse", "LargeDataCenterHighITE", "LargeDataCenterLowITE", "SmallDataCenterHighITE", "SmallDataCenterLowITE"}, selected="Warehouse")
transportationsolids = Geometry([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])
buildingsolid = DFBuildingFromSolid(bldg_geo=flatten(transportationsolids), floor_to_floor="@4", name="ParkingBldg", program=bldgprograms, run=Toggle(True))  # -> report, buildings; plug-in component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
simpleratiopar = DFSimpleWindowRatioParameters(ratio="0.15")  # -> win_par; plug-in component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
applyfacadepar = DFApplyFacadeParameters(df_obj=flatten(buildingsolid.buildings), win_par=simpleratiopar)  # -> report, df_obj; plug-in component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

# ----
# Office Buildings
bldgprograms_2 = HBBuildingPrograms({"LargeOffice", "MediumOffice", "SmallOffice", "MidriseApartment", "HighriseApartment", "Retail", "StripMall", "PrimarySchool", "SecondarySchool", "SmallHotel", "LargeHotel", "Hospital", "Outpatient", "Laboratory", "Warehouse", "SuperMarket", "FullServiceRestaurant", "QuickServiceRestaurant", "Courthouse", "LargeDataCenterHighITE", "LargeDataCenterLowITE", "SmallDataCenterHighITE", "SmallDataCenterLowITE"}, selected="LargeOffice")
officesolids = Geometry([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])
panel = Panel("""1@5
2@4
@3""")
buildingsolid_2 = DFBuildingFromSolid(bldg_geo=flatten(officesolids), floor_to_floor=panel, name="OfficeBldg", program=bldgprograms_2, run=Toggle(True))  # -> report, buildings; plug-in component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
simpleratiopar_2 = DFSimpleWindowRatioParameters(ratio="0.6")  # -> win_par; plug-in component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
applyfacadepar_2 = DFApplyFacadeParameters(df_obj=buildingsolid_2.buildings, win_par=simpleratiopar_2)  # -> report, df_obj; plug-in component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

# ----
# Residential Buildings
bldgprograms_3 = HBBuildingPrograms({"LargeOffice", "MediumOffice", "SmallOffice", "MidriseApartment", "HighriseApartment", "Retail", "StripMall", "PrimarySchool", "SecondarySchool", "SmallHotel", "LargeHotel", "Hospital", "Outpatient", "Laboratory", "Warehouse", "SuperMarket", "FullServiceRestaurant", "QuickServiceRestaurant", "Courthouse", "LargeDataCenterHighITE", "LargeDataCenterLowITE", "SmallDataCenterHighITE", "SmallDataCenterLowITE"}, selected="MidriseApartment")
residentialsolids = Geometry([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])
buildingsolid_3 = DFBuildingFromSolid(
    bldg_geo=flatten(residentialsolids),
    floor_to_floor="@3",
    name="ResidentialBldg",
    program=bldgprograms_3,
    run=Toggle(True))  # -> report, buildings; plug-in component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
simpleratiopar_3 = DFSimpleWindowRatioParameters(ratio="0.3")  # -> win_par; plug-in component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
applyfacadepar_3 = DFApplyFacadeParameters(df_obj=flatten(buildingsolid_3.buildings), win_par=simpleratiopar_3)  # -> report, df_obj; plug-in component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

# ----
# Edit Building UWG Properties
bldgvintages = HBBuildingVintages({"ASHRAE 90.1 2013  |  IECC 2015": "2013", "ASHRAE 90.1 2010  |  IECC 2012": "2010", "ASHRAE 90.1 2007  |  IECC 2009": "2007", "ASHRAE 90.1 2004  |  IECC 2006": "2004", "1980-2004 (CBECS)": "1980_2004", "Pre-1980 (CBECS)": "pre_1980"}, selected="ASHRAE 90.1 2010  |  IECC 2012")
buildinguwg = DFAssignBuildingUWGProperties(building=applyfacadepar_3.df_obj, vintage=bldgvintages, fr_canyon="1")  # -> report, building; plug-in component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

all_buildings = Data(flatten([applyfacadepar_2.df_obj, buildinguwg.building, applyfacadepar.df_obj]))

# ----
# Create Dragonfly Model
panel_2 = Panel("Trees")
trees = Geometry([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])
context = DFContextShade(geo=trees, name=panel_2, uwg_is_veg=Toggle(True))  # -> report, context; plug-in component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
model = DFModel(buildings=flatten(all_buildings), context=flatten(context.context), name="Downtown District")  # -> report, model; plug-in component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

# ----
# Weather File and Simulation Period
panel_3 = Panel("https://energyplus-weather.s3.amazonaws.com/north_and_central_america_wmo_region_4/USA/AZ/USA_AZ_Phoenix-Sky.Harbor.Intl.AP.722780_TMY3/USA_AZ_Phoenix-Sky.Harbor.Intl.AP.722780_TMY3.zip")
downloadepw = LBDownloadWeather(weather_URL=panel_3)  # -> epw_file, stat_file, ddy_file; plug-in component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
analysisperiod = LBAnalysisPeriod(start_month="7", start_day=1, start_hour=0, end_month="7")  # -> period, hoys, dates; plug-in component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

# ----
# UWG Simulation
# Parameters
panel_4 = Panel("0.6")
boundarylayer = DFBoundaryLayerParameters()  # -> bnd_layer; plug-in component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
refepwpar = DFReferenceEPWParameters(veg_cover="0.95")  # -> epw_site; plug-in component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
vegetationpar = DFVegetationParameters(albedo=panel_4)  # -> veg_par; plug-in component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

# ----
# Edit District UWG Properties
terrain = Geometry(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)
traffic = DFTrafficParameters(watts_per_area="20")  # -> traffic; plug-in component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
terrain_2 = DFTerrain(terrain_geo=terrain)  # -> terrain; plug-in component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
modeluwg = DFAssignModelUWGProperties(model=model.model, terrain=terrain_2, traffic=traffic)  # -> report, model; plug-in component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
panel_5 = Panel(modeluwg.report)

uwgsimpar = DFUWGSimulationParameter(run_period=analysisperiod.period, veg_par=vegetationpar, epw_site=refepwpar, bnd_layer=boundarylayer)  # -> sim_par; plug-in component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
toggle = BooleanToggle(False)
runuwg = DFRunUrbanWeatherGenerator(model=modeluwg.model, epw_file=downloadepw.epw_file, sim_par=uwgsimpar, write=toggle, run=toggle)  # -> report, uwg_json, urban_epw; plug-in component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

# ----
# Visualize EPW Output
importepw = LBImportEPW(epw_file=downloadepw.epw_file)  # -> location, dry_bulb_temperature, dew_point_temperature, relative_humidity, wind_speed, wind_direction, direct_normal_rad, diffuse_horizontal_rad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; plug-in component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
importepw_2 = LBImportEPW(epw_file=runuwg.urban_epw)  # -> location, dry_bulb_temperature, dew_point_temperature, relative_humidity, wind_speed, wind_direction, direct_normal_rad, diffuse_horizontal_rad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; plug-in component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
applyper = LBApplyAnalysisPeriod(data=importepw_2.dry_bulb_temperature, period=analysisperiod.period)  # -> data; plug-in component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
applyper_2 = LBApplyAnalysisPeriod(data=importepw.dry_bulb_temperature, period=analysisperiod.period)  # -> data; plug-in component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
timeop = LBTimeIntervalOperation(data=applyper)  # -> daily, monthly, mon_per_hr; plug-in component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
legendpar = LBLegendParameters(min="30", max="42", seg_count="13", num_decimals="0")  # -> leg_par; plug-in component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
timeop_2 = LBTimeIntervalOperation(data=applyper_2)  # -> daily, monthly, mon_per_hr; plug-in component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
gate = StreamGate(Stream=[timeop_2.mon_per_hr, timeop.mon_per_hr], Gate=toggle)  # -> Target0, Target1

monthlychart = LBMonthlyChart(data=gate.Target1, base_pt="250,0,0", x_dim="40", time_marks=Toggle(True), legend_par=legendpar)  # -> report, data_mesh, data_lines, col_lines, legend, borders, labels, y_title, title; plug-in component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
