# Grasshopper definition Analyze_THERM_Results_for_Condensation_Risk.gh (Grasshopper 1.0.7)

# ----
# Find the Coldest Temperature in the Climate of the Project
panel = Panel("https://energyplus-weather.s3.amazonaws.com/north_and_central_america_wmo_region_4/USA/IL/USA_IL_Chicago-OHare.Intl.AP.725300_TMY3/USA_IL_Chicago-OHare.Intl.AP.725300_TMY3.zip")
downloadepw = LBDownloadWeather(weather_URL=panel)  # -> epw_file, stat_file, ddy_file; plug-in component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
importstat = LBImportSTAT(stat_file=downloadepw.stat_file)  # -> location, ashrae_zone, koppen_zone, clear_dir_norm_rad, clear_diff_horiz_rad, ann_heat_dday_996, ann_heat_dday_990, ann_cool_dday_004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; plug-in component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
decnstrdesignday = LBDeconstructDesignDay(design_day=importstat.ann_heat_dday_996)  # -> name, day_type, location, date, dry_bulb_max, dry_bulb_range, humidity_type, humidity_value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; plug-in component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

crv = Curve(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)
# Create Boundary Conditions
crv_2 = Curve(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)
boundary = FFBoundary(geo=crv, name="ChicagoExterior", temperature=decnstrdesignday.dry_bulb_max, film_coeff="26")  # -> report, boundaries; plug-in component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
boundary_2 = FFBoundary(geo=crv_2, name="Interior", temperature="22", film_coeff="3.2")  # -> report, boundaries; plug-in component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

# ----
# Create THERM Polygons
glass = Geometry([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])
air = Geometry([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])
insul = Geometry([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])
brick = Geometry(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)
wood = Geometry([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])
rubber = Geometry([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])
gypsum = Geometry([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])
aluminum = Geometry([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])
concrete = Geometry([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])
urethane = Geometry(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)
shape = FFShape(geo=air, material="Frame Cavity Slightly Ventilated NFRC 100")  # -> report, shapes; plug-in component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
shape_2 = FFShape(geo=glass, material="Generic Clear Glass")  # -> report, shapes; plug-in component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
shape_3 = FFShape(geo=wood, material="G05 25mm wood", rgb_color=ColourSwatch(SwatchColor=RGB(204, 170, 0)))  # -> report, shapes; plug-in component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
shape_4 = FFShape(geo=insul, material="Extruded Polystyrene (XPS) with CFC and HCFC")  # -> report, shapes; plug-in component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
shape_5 = FFShape(geo=gypsum, material="1/2IN Gypsum")  # -> report, shapes; plug-in component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
shape_6 = FFShape(geo=brick, material="M01 100mm brick", rgb_color=ColourSwatch(SwatchColor=RGB(194, 72, 72)))  # -> report, shapes; plug-in component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
shape_7 = FFShape(geo=aluminum, material="Aluminum (Painted)")  # -> report, shapes; plug-in component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
shape_8 = FFShape(geo=concrete, material="Generic HW Concrete")  # -> report, shapes; plug-in component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
shape_9 = FFShape(geo=rubber, material="Butyl rubber")  # -> report, shapes; plug-in component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
shape_10 = FFShape(geo=urethane, material="Urethane / Polyurethane")  # -> report, shapes; plug-in component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

toggle = BooleanToggle(False)

# ----
# Run the Simulation
panel_2 = Panel("HospitalDetailTop")
data = Data([shape_2.shapes, shape.shapes, shape_4.shapes, shape_5.shapes, shape_6.shapes, shape_3.shapes, shape_7.shapes, shape_8.shapes, shape_9.shapes, shape_10.shapes])
data_2 = Data([boundary_2.boundaries, boundary.boundaries])
meshing = FFMeshingControl(parameter="25")  # -> meshing; plug-in component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
model = FFModel(shapes=flatten(data), boundaries=flatten(data_2), name=panel_2)  # -> report, model; plug-in component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
modeltothmz = FFModelToTHMZ(model=model.model, meshing=meshing, write=toggle, run=toggle)  # -> report, thmz; plug-in component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

# ----
# Change the Indoor
# Humidification Level
number_slider = Slider(30, range=0..50)
humidityr = LBHumidityMetrics(dry_bulb="22", rel_humid=number_slider)  # -> humid_ratio, enthalpy, wet_bulb, dew_point; plug-in component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
thermresult = FFReadTHERMResult(thmz=modeltothmz.thmz)  # -> report, shape_geo, points, results, mesh, legend, title, vis_set; plug-in component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

# ----
# Create a Dark Version of the Mesh (to show where the dewpoint line is)
panel_3 = Panel("20")
colrange = LBColorRange(index=panel_3)  # -> colors; plug-in component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
ahsv = SplitAHSV(Colour=colrange)  # -> Alpha, Hue, Saturation, Value
multiplication = Multiplication(A=ahsv.Value, B="0.3")
hsl = ColourHSL(Alpha=ahsv.Alpha, Hue=ahsv.Hue, Saturation=ahsv.Saturation, Luminance=multiplication)
legendpar = LBLegendParameters(colors=hsl)  # -> leg_par; plug-in component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
heatmap = LBSpatialHeatmap(values=thermresult.results, mesh=thermresult.mesh, legend_par=legendpar)  # -> mesh, legend, title, colors, legend_par, vis_set; plug-in component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

# ----
# Cull Parts of Mesh Beyond the Dewpoint Line
panel_4 = Panel("0, 0, 0.1")
smaller = SmallerThan(FirstNumber=thermresult.results, SecondNumber=humidityr.dew_point)  # -> SmallerThan, OrEqualTo
move = Move(Geometry=thermresult.mesh, Motion=panel_4)  # -> Geometry, Transform
cullv = CullVertices(Mesh=move.Geometry, Pattern=smaller.SmallerThan, Shrink=True)
medges = MeshEdges(Mesh=cullv)  # -> NakedEdges, InteriorEdges, NonManifoldEdges
geo = Geometry(medges.NakedEdges)
preview = CustomPreview(Geometry=geo, Shader=ColourSwatch(SwatchColor=RGB(255, 255, 255)))

move_2 = Move(Geometry=thermresult.shape_geo, Motion=panel_4)  # -> Geometry, Transform

edges = BrepEdges(Brep=move_2.Geometry)  # -> Naked, Interior, NonManifold
