# Grasshopper definition THERM_Comparison_of_Stud_Wall_Constructions.gh (Grasshopper 1.0.7)

# ----
# BOUNDARIES FOR METAL STUD WALL
exteriorboundary = Curve(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)
interiorboundary = Curve(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)
boundary = FFBoundary(
    geo=interiorboundary,
    name="Interior",
    temperature="21",
    film_coeff="3",
    u_factor_tag="WallAssembly",
    rgb_color=ColourSwatch(SwatchColor=RGB(255, 191, 0)))  # -> report, boundaries; plug-in component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
boundary_2 = FFBoundary(
    geo=exteriorboundary,
    name="Exterior",
    temperature="-18",
    film_coeff="26",
    rgb_color=ColourSwatch(SwatchColor=RGB(0, 170, 255)))  # -> report, boundaries; plug-in component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

# ----
# POLYGONS FOR METAL STUD WALL
gypsum = Geometry(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)
insulation = Geometry([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])
steelstuds = Geometry([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])
plywood = Geometry(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)
air_gap = Geometry(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)
brick = Geometry(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)
shape = FFShape(geo=gypsum, material="1/2IN Gypsum", rgb_color=ColourSwatch(SwatchColor=RGB(217, 217, 217)))  # -> report, shapes; plug-in component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
shape_2 = FFShape(geo=insulation, material="Cellulose, Cellulosic Fiber, Cotton Fiber")  # -> report, shapes; plug-in component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
shape_3 = FFShape(geo=plywood, material="G05 25mm wood", rgb_color=ColourSwatch(SwatchColor=RGB(204, 170, 0)))  # -> report, shapes; plug-in component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
shape_4 = FFShape(geo=air_gap, material="Frame Cavity Slightly Ventilated NFRC 100")  # -> report, shapes; plug-in component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
shape_5 = FFShape(geo=brick, material="M01 100mm brick", rgb_color=ColourSwatch(SwatchColor=RGB(194, 72, 72)))  # -> report, shapes; plug-in component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
shape_6 = FFShape(geo=steelstuds, material="Steel - Stainless (Buffed)")  # -> report, shapes; plug-in component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

# ----
# POLYGONS FOR WOOD STUD WALL
gypsum_2 = Geometry(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)
insulation_2 = Geometry([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])
woodstuds = Geometry([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])
plywood_2 = Geometry(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)
air_gap_2 = Geometry(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)
brick_2 = Geometry(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)
shape_7 = FFShape(geo=gypsum_2, material="1/2IN Gypsum", rgb_color=ColourSwatch(SwatchColor=RGB(217, 217, 217)))  # -> report, shapes; plug-in component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
shape_8 = FFShape(geo=insulation_2, material="Cellulose, Cellulosic Fiber, Cotton Fiber")  # -> report, shapes; plug-in component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
shape_9 = FFShape(geo=[woodstuds, plywood_2], material="G05 25mm wood", rgb_color=ColourSwatch(SwatchColor=RGB(204, 170, 0)))  # -> report, shapes; plug-in component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
shape_10 = FFShape(geo=air_gap_2, material="Frame Cavity Slightly Ventilated NFRC 100")  # -> report, shapes; plug-in component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
shape_11 = FFShape(geo=brick_2, material="M01 100mm brick", rgb_color=ColourSwatch(SwatchColor=RGB(194, 72, 72)))  # -> report, shapes; plug-in component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

# ----
# BOUNDARIES FOR WOOD STUD WALL
exteriorboundary_2 = Curve(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)
interiorboundary_2 = Curve(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)
boundary_3 = FFBoundary(
    geo=interiorboundary_2,
    name="Interior",
    temperature="21",
    film_coeff="3",
    u_factor_tag="WallAssembly",
    rgb_color=ColourSwatch(SwatchColor=RGB(255, 191, 0)))  # -> report, boundaries; plug-in component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
boundary_4 = FFBoundary(
    geo=exteriorboundary_2,
    name="Exterior",
    temperature="-18",
    film_coeff="26",
    rgb_color=ColourSwatch(SwatchColor=RGB(0, 170, 255)))  # -> report, boundaries; plug-in component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

data = Data(flatten([shape_5.shapes, shape_2.shapes, shape.shapes, shape_3.shapes, shape_6.shapes, shape_4.shapes]))
data_2 = Data(flatten([boundary_2.boundaries, boundary.boundaries]))
data_3 = Data(flatten([shape_7.shapes, shape_8.shapes, shape_9.shapes, shape_10.shapes, shape_11.shapes]))
data_4 = Data(flatten([boundary_4.boundaries, boundary_3.boundaries]))
model = FFModel(shapes=flatten(data), boundaries=flatten(data_2), name="Metal Stud Wall")  # -> report, model; plug-in component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
model_2 = FFModel(shapes=flatten(data_3), boundaries=flatten(data_4), name="Wood Stud Wall")  # -> report, model; plug-in component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
toggle = BooleanToggle(False)

# ----
# WRITE GEOMETRY TO THERM
modeltothmz = FFModelToTHMZ(model=model_2.model, write=toggle, run=toggle)  # -> report, thmz; plug-in component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

# ----
# MAKE THE LEGEND
# CONSTANT FOR AN
# EQUAL COMPARISON
panel = Panel("100")
legendpar = LBLegendParameters(min="0", max=panel)  # -> leg_par; plug-in component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

# ----
# IMPORT THERM RESULTS
panel_2 = Panel("1")
thermresult = FFReadTHERMResult(thmz=modeltothmz.thmz, data_type=panel_2, legend_par=legendpar)  # -> report, shape_geo, points, results, mesh, legend, title, vis_set; plug-in component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
ufactorresult = FFReadUFactorResult(thmz=modeltothmz.thmz)  # -> report, tags, u_factors, lengths; plug-in component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

# ---- group: Calculate R-Value
# COMPARE CASES
panel_3 = Panel("1")
division = Division(A=panel_3, B=ufactorresult.u_factors)

# ----
r_value_from_wood_sim = Data(division)
r_value = Panel(r_value_from_wood_sim)

r_value_from_steel_sim = Data(2.642887725)
r_value_w_steel = Panel(r_value_from_steel_sim)
