# Grasshopper definition THERM_Export_Workflow.gh (Grasshopper 1.0.7)

# ----
# Optionally Add Solar Flux
number_slider = Slider(0, range=0..10, expression="x * 100")
radenv = FFRadiantEnvironment(heat_flux=number_slider)  # -> rad_env; plug-in component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

# ----
# 2) Define THERM Boundary Conditions
# with Temperatures and U-Factor Tags
exteriorboundary = Curve(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)
interiorboundary = Curve(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)
boundary = FFBoundary(
    geo=interiorboundary,
    name="Interior",
    temperature="21",
    film_coeff="3",
    u_factor_tag="WallAssembly",
    rgb_color=ColourSwatch(SwatchColor=RGB(255, 191, 0)))  # -> report, boundaries; plug-in component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
boundary_2 = FFBoundary(
    geo=exteriorboundary,
    name="Exterior",
    temperature="-18",
    film_coeff="26",
    rad_env=radenv,
    rgb_color=ColourSwatch(SwatchColor=RGB(0, 170, 255)))  # -> report, boundaries; plug-in component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

# ----
# CREATE A THERM MODEL
# 1) Define THERM Polygons With Materials
gypsum = Geometry(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)
steelstuds = Geometry([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])
plywood = Geometry(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)
brick = Geometry(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)
insulation = Geometry([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])
air_gap = Geometry(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)
shape = FFShape(geo=gypsum, material="1/2IN Gypsum", rgb_color=ColourSwatch(SwatchColor=RGB(217, 217, 217)))  # -> report, shapes; plug-in component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
shape_2 = FFShape(geo=insulation, material="Cellulose, Cellulosic Fiber, Cotton Fiber")  # -> report, shapes; plug-in component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
shape_3 = FFShape(geo=plywood, material="G05 25mm wood", rgb_color=ColourSwatch(SwatchColor=RGB(204, 170, 0)))  # -> report, shapes; plug-in component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
shape_4 = FFShape(geo=air_gap, material="Frame Cavity Slightly Ventilated NFRC 100")  # -> report, shapes; plug-in component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
shape_5 = FFShape(geo=brick, material="M01 100mm brick", rgb_color=ColourSwatch(SwatchColor=RGB(194, 72, 72)))  # -> report, shapes; plug-in component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
shape_6 = FFShape(geo=steelstuds, material="Steel - Stainless (Buffed)")  # -> report, shapes; plug-in component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

data = Data(flatten([shape_5.shapes, shape_2.shapes, shape.shapes, shape_3.shapes, shape_6.shapes, shape_4.shapes]))
data_2 = Data(flatten([boundary_2.boundaries, boundary.boundaries]))
model = FFModel(shapes=flatten(data), boundaries=flatten(data_2), name="Therm Stud Wall")  # -> report, model; plug-in component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
toggle = BooleanToggle(False)

# ----
# 5) Customize the graphics
# with LegendPar
panel = Panel("2")
colrange = LBColorRange(index=panel)  # -> colors; plug-in component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
legendpar = LBLegendParameters(min="-18", max="21", colors=colrange, num_decimals="1")  # -> leg_par; plug-in component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

# ----
# 3) Write the Model
# into a THMZ File
modeltothmz = FFModelToTHMZ(model=model.model, write=toggle, run=toggle)  # -> report, thmz; plug-in component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

# ----
# Serialize the Model to/from a JSON file
toggle_2 = BooleanToggle(False)
dumpobjects = FFDumpObjects(ff_objs=flatten(model.model), dump=toggle_2)  # -> report, ff_file; plug-in component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
loadobjects = FFLoadObjects(ff_file=dumpobjects.ff_file, load=Toggle(False))  # -> report, ff_objs; plug-in component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

# ----
# Preview Model Attributes
boundaryattr = HBFaceAttributes({"Display Name": "display_name", "Simulation Name (Identifier)": "identifier", "Length": "length", "Condition": "properties.therm.condition.display_name", "Temperature [C]": "properties.therm.condition.temperature", "Film Coefficient [W/m2-K]": "properties.therm.condition.film_coefficient", "Radiant Temperature [C]": "properties.therm.condition.radiant_temperature", "Emissivity": "properties.therm.condition.emissivity", "Additional Heat Flux [W/m2]": "properties.therm.condition.heat_flux"}, selected="Temperature [C]")
shapeattr = FFShapeAttributes({"Display Name": "display_name", "Simulation Name (Identifier)": "identifier", "Area": "area", "Material": "properties.therm.material.display_name", "Conductivity [W/m-K]": "properties.therm.material.conductivity", "Resistivity [m-K/W]": "properties.therm.material.resistivity", "Emissivity": "properties.therm.material.emissivity", "Density [kg/m3]": "properties.therm.material.density", "Specific Heat [J/kg-K]": "properties.therm.material.specific_heat", "Porosity": "properties.therm.material.porosity", "Vapor Resistance": "properties.therm.material.vapor_diffusion_resistance", "Cavity Model": "properties.therm.material.cavity_model"}, selected="Material")
colorboundaryattr = FFColorBoundaryAttributes(ff_objs=flatten(model.model), attribute=boundaryattr)  # -> wire_frame, legend, lines, values, colors; plug-in component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
colorshapeattr = FFColorShapeAttributes(ff_objs=flatten(model.model), attribute=shapeattr)  # -> wire_frame, legend, mesh, values, colors; plug-in component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

path = FilePath(modeltothmz.thmz)

# ----
# Use Thermally-Bridged U-Values to
# Inform Your EnergyPlus Simulations!
# Dive Deep Into the
# Mesh Results!
# 4) Import results!!
thermresult = FFReadTHERMResult(thmz=path, legend_par=legendpar)  # -> report, shape_geo, points, results, mesh, legend, title, vis_set; plug-in component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
ufactorresult = FFReadUFactorResult(thmz=path)  # -> report, tags, u_factors, lengths; plug-in component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
tag_name = Panel(ufactorresult.tags)
u_factor = Panel(ufactorresult.u_factors)
temperatures_c = Panel(thermresult.results)
length = Panel(ufactorresult.lengths)

# ----
# Display Contours
panel_2 = Panel("-14")
legendpar_2 = LBLegendParameters(min=panel_2, max="16", seg_count="6", num_decimals="0", text_height="0.015")  # -> leg_par; plug-in component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
contourmesh = LBContourMesh(values=thermresult.results, mesh=thermresult.mesh, legend_par=legendpar_2, smooth_iter="3")  # -> report, contours, labels, mesh, legend, title, vis_set; plug-in component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
geo = Geometry([contourmesh.contours, contourmesh.labels])

searchmats = HBSearchMaterials()  # -> opaque_mats, window_mats; plug-in component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
# EXPLORE MATERIALS
searchmats_2 = FFSearchMaterials()  # -> solid_mats, cavity_mats; plug-in component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
energy_opaque_materials = Panel(searchmats.opaque_mats)
therm_cavity_materials = Panel(searchmats_2.cavity_mats)
therm_solid_materials = Panel(searchmats_2.solid_mats)

# ----
# Use Materials from Either the THERM or EnergyPlus Libraries
# Look Up Properties of Materials
# Frame Cavity NFRC 100
# ... Or Create Your Own Materials
# Any Material can be connected up
# to the '_material' input of the
# "FF Shape"s Component
panel_3 = Panel("Aerogel")
solidmat = FFSolidMaterial(name=panel_3, conductivity="0.03")  # -> mat; plug-in component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
cavitymat = FFCavityMaterial(name="Argon Cavity", cavity_model="ISO15099", gas_type="Argon")  # -> mat; plug-in component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
panel_4 = Panel("Foam Glass")
decnstrmat = HBDeconstructMaterial(mat="1IN Stucco")  # -> values, attr_names, r_val_si, r_val_ip; plug-in component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
panel_5 = Panel(decnstrmat.values)
panel_6 = Panel(decnstrmat.attr_names)

decnstrmat_2 = FFDeconstructMaterial(mat="Aerated Concrete")  # -> values, attr_names; plug-in component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

panel_7 = Panel(decnstrmat_2.values)
panel_8 = Panel(decnstrmat_2.attr_names)
