# Grasshopper definition adaptive_comfort_chart.gh (Grasshopper 1.0.7)

# ---- group: Chage Glazing Ratio, Orientation, and Program
number_slider = Slider(0.3, range=0.1..0.9)
number_slider_2 = Slider(0, range=0..8, expression="x * 45")

# ----
# Create Honeybee Room
panel = Panel("outdoors")
geo = Geometry(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)
geo_2 = Geometry([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])
face = HBFace(geo=geo, bc=panel)  # -> report, faces; plug-in component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
face_2 = HBFace(geo=geo_2, bc="adiabatic")  # -> report, faces; plug-in component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
panel_2 = Panel("2019::LargeOffice::OpenOffice")
aperturesbyratio = HBAperturesByRatio(hb_objs=flatten(face.faces), ratio=number_slider, subdivide=Toggle(False), operable=Toggle(True))  # -> report, hb_objs; plug-in component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
ventcontrol = HBVentilationControl(min_in_temp="21")  # -> vent_cntrl; plug-in component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
room = HBRoom(
    faces=flatten([face_2.faces, aperturesbyratio.hb_objs]),
    name="Office Shoe Box",
    constr_set="2004::ClimateZone3::SteelFramed",
    program=panel_2,
    conditioned=Toggle(False))  # -> report, room; plug-in component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
windowopen = HBWindowOpening(rooms=flatten(room.room), vent_cntrl=ventcontrol)  # -> report, rooms; plug-in component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
rotate = HBRotate(hb_objs=flatten(windowopen.rooms), angle=number_slider_2)  # -> hb_objs; plug-in component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
model = HBModel(rooms=flatten(rotate))  # -> report, model; plug-in component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

# ----
# Request Comfort Outputs
toggle = BooleanToggle(True)
simoutput = HBSimulationOutput(comfort_metrics=toggle)  # -> report, sim_output; plug-in component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
simpar = HBSimulationParameter(output=simoutput.sim_output, timestep=6)  # -> sim_par; plug-in component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

# ----
# Download EPW File
panel_3 = Panel("https://energyplus-weather.s3.amazonaws.com/north_and_central_america_wmo_region_4/USA/CA/USA_CA_Los.Angeles.722950_TMY2/USA_CA_Los.Angeles.722950_TMY2.zip")
downloadepw = LBDownloadWeather(weather_URL=panel_3)  # -> epw_file, stat_file, ddy_file; plug-in component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

# ----
# Extract Occupancy Schedule
deconstrprogram = HBDeconstructProgramType(program=panel_2)  # -> people, lighting, electric_equip, gas_equip, hot_water, infiltration, ventilation, setpoint; plug-in component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
decnstrpeople = HBDeconstructPeople(people=deconstrprogram.people)  # -> name, ppl_per_area, occupancy_sch, activity_sch; plug-in component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
schtodata = HBScheduleToData(schedule=decnstrpeople.occupancy_sch)  # -> data; plug-in component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

# ---- group: Run Me!
toggle_2 = BooleanToggle(False)

# ----
importepw = LBImportEPW(epw_file=downloadepw.epw_file)  # -> location, dry_bulb_temperature, dew_point_temperature, relative_humidity, wind_speed, wind_direction, direct_normal_rad, diffuse_horizontal_rad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; plug-in component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
modeltoosm = HBModelToOSM(model=model.model, epw_file=downloadepw.epw_file, sim_par=simpar, write=toggle_2, run=toggle_2)  # -> report, jsons, osw, osm, idf, sql, zsz, rdd, html; plug-in component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
roomcomfortresult = HBReadRoomComfortResult(sql=modeltoosm.sql)  # -> oper_temp, air_temp, rad_temp, rel_humidity, unmet_heat, unmet_cool; plug-in component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

dom = ConstructDomain(DomainStart=Slider(6, range=0..20), DomainEnd=Slider(32, range=30..40))

evaluate_only_occupied_hours = Panel("a > 0.1")
adaptpar = LBAdaptiveComfortParameters(ashrae_or_en=Toggle(True), avgm_or_runmean=Toggle(False), conditioning=Slider(0, range=0..1))  # -> adapt_par; plug-in component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
adaptivechart = LBAdaptiveChart(
    out_temp=importepw.dry_bulb_temperature,
    air_temp=roomcomfortresult.air_temp,
    mrt=roomcomfortresult.rad_temp,
    air_speed=Slider(1.2, range=0..1.2),
    adapt_par=adaptpar,
    prevail_range=dom,
    data=schtodata,
    statement=evaluate_only_occupied_hours)  # -> report, total_comfort, comfort_data, condition_data, polygon, title, prevail_lines, operative_lines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; plug-in component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
panel_4 = Panel(adaptivechart.total_comfort)

hourlyplot = LBHourlyPlot(data=adaptivechart.condition_data, base_pt="-120, 0, 0", x_dim="0.25", y_dim="1")  # -> report, mesh, legend, borders, labels, title, vis_set; plug-in component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
