# Grasshopper definition creating_constructions.gh (Grasshopper 1.0.7)

# ----
# Create New ConstructionSet
interiorsubset = HBInteriorConstructionSubset()  # -> interior_set; plug-in component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
subfacesubset = HBSubfaceSubset()  # -> subface_set; plug-in component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
exteriorsubset = HBExteriorConstructionSubset()  # -> exterior_set; plug-in component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
groundsubset = HBGroundConstructionSubset()  # -> ground_set; plug-in component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
constructionset = HBConstructionSet(
    name="CustomSet",
    exterior_subset=exteriorsubset,
    ground_subset=groundsubset,
    interior_subset=interiorsubset,
    subface_subset=subfacesubset)  # -> constr_set; plug-in component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

# ----
# Browse ConstructionSets
constructiontypes = HBConstructionTypes({"SteelFramed", "WoodFramed", "Mass", "Metal Building"}, selected="SteelFramed")
climatezones = HBClimateZones({"1 - Very Hot": "1", "2 - Hot": "2", "3 - Warm": "3", "4 - Mixed": "4", "5 - Cool": "5", "6 - Cold": "6", "7 - Very Cold": "7", "8 - Subarctic": "8"}, selected="5 - Cool")
searchconstrset = HBSearchConstructionSets(keywords="Generic")  # -> constr_sets; plug-in component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
constrsetclimate = HBConstructionSetByClimate(climate_zone=climatezones, constr_type=constructiontypes)  # -> constr_set; plug-in component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
panel = Panel(searchconstrset)
panel_2 = Panel(constrsetclimate)

# ----
# Search Construction/Material Libraries
searchconstrs = HBSearchConstructions()  # -> opaque_constrs, window_constrs, shade_constrs; plug-in component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
searchmats = HBSearchMaterials()  # -> opaque_mats, window_mats; plug-in component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
panel_3 = Panel(searchconstrs.opaque_constrs)

# ----
# Apply Constructions
# to Objects
applyopaqueconstr = HBApplyOpaqueConstruction()  # -> hb_objs; plug-in component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
applywindowconstr = HBApplyWindowConstruction()  # -> hb_objs; plug-in component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
applyshadeconstr = HBApplyShadeConstruction()  # -> hb_objs; plug-in component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
applyconstrset = HBApplyConstructionSet()  # -> rooms; plug-in component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

# ----
# Deconstruct ConstructionSet, Constructions, Materials
construction_set = Data(constrsetclimate)
decnstrconstrsetint = HBDeconstructConstructionSetInterior(constr_set=construction_set)  # -> interior_wall, ceiling, interior_floor, interior_window, interior_door, int_glass_door; plug-in component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
decnstrconstrset = HBDeconstructConstructionSet(constr_set=construction_set)  # -> exterior_wall, exterior_roof, exposed_floor, ground_wall, ground_roof, ground_floor, window, skylight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; plug-in component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
panel_4 = Panel(decnstrconstrset.exterior_wall)
panel_5 = Panel(decnstrconstrsetint.ceiling)
decnstrconstr = HBDeconstructConstruction(constr=decnstrconstrset.exterior_wall)  # -> materials, layers, r_val_si, r_val_ip, u_fac_si, u_fac_ip, shgc, t_sol, t_vis; plug-in component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
panel_6 = Panel(decnstrconstr.t_sol)
panel_7 = Panel(decnstrconstr.r_val_ip)
panel_8 = Panel(decnstrconstr.layers)
decnstrmat = HBDeconstructMaterial(mat=decnstrconstr.materials)  # -> values, attr_names, r_val_si, r_val_ip; plug-in component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
panel_9 = Panel(decnstrmat.values)
panel_10 = Panel(decnstrmat.attr_names)

# ----
# Create Materials
panel_11 = Panel("Custom Window System")
panel_12 = Panel("""Argon
Air""")
panel_13 = Panel("""0.9
0.1""")
customgapmat = HBCustomWindowGapMaterial(
    name="Carbon Dioxide",
    thickness="0.0125",
    conductivity_a="0.0001",
    viscosity_a="0.000014",
    specific_heat_a="827.73",
    spec_heat_ratio="1.4",
    mol_weight="44")  # -> mat; plug-in component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
glassmat = HBGlassMaterial(name="Safety Glass", thickness="0.02")  # -> mat; plug-in component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
blindmat = HBBlindMaterial(name="WoodenBlind", slat_separation="0.03", slat_thickness="0.01", slat_angle="90", conductivity="0.14")  # -> mat; plug-in component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
shademat = HBShadeMaterial(name="InsulatingShade", thickness="0.02", conductivity="0.02")  # -> mat; plug-in component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
opaquematnomass = HBOpaqueMaterialNoMass(name="NoMassInsulation", r_value="2")  # -> mat; plug-in component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
opaquemat = HBOpaqueMaterial(name="Concrete Custom", thickness="0.25", conductivity="0.7195", density="1856", spec_heat="839.4")  # -> mat; plug-in component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
gapmat = HBWindowGapMaterial(name="Air Argon Mixture", gas_types=panel_12, gas_ratios=panel_13)  # -> mat; plug-in component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
windowmat = HBWindowMaterial(name=panel_11, u_factor="1.25", shgc="0.35")  # -> mat; plug-in component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
panel_14 = Panel(opaquematnomass)
panel_15 = Panel(windowmat)
panel_16 = Panel(customgapmat)
panel_17 = Panel(opaquemat)
panel_18 = Panel(gapmat)
panel_19 = Panel(shademat)
panel_20 = Panel(glassmat)
panel_21 = Panel(blindmat)

# ----
# Create Constructions
panel_22 = Panel("Aluminup Frame With Thermal Break")
windowframe = HBWindowFrame(name=panel_22, width="0.75", conductance="56.4")  # -> frame; plug-in component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
merge = Merge(Data1="1IN Stucco", Data2="Typical Insulation-R10", Data3="Generic Wall Air Gap", Data4="1/2 in. Gypsum Board")
merge_2 = Merge(Data1="Generic Low-e Glass", Data2="Generic Window Argon Gap", Data3="Generic Clear Glass")
opaqueconstr = HBOpaqueConstruction(name="Custom Constr", materials=merge)  # -> constr; plug-in component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
shadeconstr = HBShadeConstruction(name="Glass Facade", sol_ref="0.3", vis_ref="0.3", specular=Toggle(True))  # -> constr; plug-in component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
panel_23 = Panel(shadeconstr)
panel_24 = Panel(opaqueconstr)

windowconstr = HBWindowConstruction(name="High Insulation Glass", materials=merge_2, frame=windowframe)  # -> constr; plug-in component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

panel_25 = Panel(windowconstr)
