# Grasshopper definition creating_programs.gh (Grasshopper 1.0.7)

# ----
# Browse ProgramTypes
bldgvintages = HBBuildingVintages({"ASHRAE 90.1 2013  |  IECC 2015": "2013", "ASHRAE 90.1 2010  |  IECC 2012": "2010", "ASHRAE 90.1 2007  |  IECC 2009": "2007", "ASHRAE 90.1 2004  |  IECC 2006": "2004", "1980-2004 (CBECS)": "1980_2004", "Pre-1980 (CBECS)": "pre_1980"}, selected="ASHRAE 90.1 2013  |  IECC 2015")
bldgprograms = HBBuildingPrograms({"LargeOffice", "MediumOffice", "SmallOffice", "MidriseApartment", "HighriseApartment", "Retail", "StripMall", "PrimarySchool", "SecondarySchool", "SmallHotel", "LargeHotel", "Hospital", "Outpatient", "Laboratory", "Warehouse", "SuperMarket", "FullServiceRestaurant", "QuickServiceRestaurant", "Courthouse", "College", "LargeDataCenterHighITE", "LargeDataCenterLowITE", "SmallDataCenterHighITE", "SmallDataCenterLowITE"}, selected="LargeOffice")
searchprog = HBSearchPrograms(bldg_prog=bldgprograms, vintage=bldgvintages)  # -> room_prog; plug-in component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
panel = Panel(searchprog)

# ----
# Blend ProgramTypes
panel_2 = Panel("""2013::LargeOffice::ClosedOffice
2013::LargeOffice::Conference
2013::LargeOffice::Corridor
2013::LargeOffice::IT_Room
2013::LargeOffice::OpenOffice
2013::LargeOffice::PrintRoom
2013::LargeOffice::Restroom
2013::LargeOffice::Storage""")
panel_3 = Panel("""0.05
0.15
0.2
0.05
0.4
0.05
0.05
0.05""")
blendprograms = HBBlendProgramTypes(name="Full Building Office", programs=panel_2, ratios=panel_3)  # -> program; plug-in component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

# ----
# Create New ProgramType
panel_4 = Panel("SchoolSecondary HTGSETP_SCH_YES_OPTIMUM")
setpoint = HBSetpoint(name="University Setpoint", heating_sch=panel_4, cooling_sch="SchoolSecondary CLGSETP_SCH_NO_SETBACK")  # -> setpoint; plug-in component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
lighting = HBLighting(name="University Lighting", watts_per_area="6", schedule="SchoolPrimary BLDG_LIGHT_GYM_SCH", baseline="10")  # -> lighting; plug-in component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
infiltration = HBInfiltration(name="University Infiltration", flow_per_ext_area="0.0003")  # -> infil; plug-in component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
ventilation = HBVentilation(name="University Ventilation", flow_per_person="0.01", method="Max")  # -> vent; plug-in component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
equipment = HBEquipment(name="University Equipment", watts_per_area="5", schedule="SchoolPrimary BLDG_EQUIP_SCH_2010")  # -> equip; plug-in component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
people = HBPeople(name="University People", ppl_per_area="0.05", occupancy_sch="PrimarySchool Bldg Occ")  # -> people; plug-in component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
programtype = HBProgramType(
    name="University Classroom",
    people=people,
    lighting=lighting,
    electric_equip=equipment,
    infiltration=infiltration,
    ventilation=ventilation,
    setpoint=setpoint)  # -> program; plug-in component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

# ----
# Assign Programs/Loads
applyprogram = HBApplyProgramType()  # -> report, rooms; plug-in component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
applysetpointvals = HBApplySetpointValues()  # -> report, mod_obj; plug-in component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
applyloadvals = HBApplyLoadValues()  # -> report, mod_obj; plug-in component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
absoluteloadvals = HBApplyAbsoluteLoadValues()  # -> report, rooms; plug-in component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

# ----
# Deconstruct Program
panel_5 = Panel("2013::MediumOffice::ClosedOffice")

deconstrprogram = HBDeconstructProgramType(program=panel_5)  # -> people, lighting, electric_equip, gas_equip, hot_water, infiltration, ventilation, setpoint; plug-in component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

decnstrlighting = HBDeconstructLighting(lighting=deconstrprogram.lighting)  # -> name, watts_per_area, schedule, radiant_fract, visible_fract, return_fract, baseline; plug-in component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
decnstrsetpoint = HBDeconstructSetpoint(setpoint=deconstrprogram.setpoint)  # -> name, heating_sch, cooling_sch, humid_setpt, dehumid_setpt; plug-in component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
decnstrinfiltration = HBDeconstructInfiltration(infil=deconstrprogram.infiltration)  # -> name, flow_per_ext_area, schedule; plug-in component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
decnstrequipment = HBDeconstructEquipment(equip=deconstrprogram.electric_equip)  # -> name, watts_per_area, schedule, radiant_fract, latent_fract, lost_fract, is_gas; plug-in component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
decnstrventilation = HBDeconstructVentilation(vent=deconstrprogram.ventilation)  # -> name, flow_per_person, flow_per_area, flow_per_zone, ach, schedule; plug-in component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
decnstrpeople = HBDeconstructPeople(people=deconstrprogram.people)  # -> name, ppl_per_area, occupancy_sch, activity_sch; plug-in component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
deconstrsch = HBDeconstructSchedule(schedule=decnstrpeople.occupancy_sch)  # -> day_names, day_data, type_limit; plug-in component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
panel_6 = Panel(decnstrpeople.ppl_per_area)
panel_7 = Panel(decnstrpeople.name)
xdata = LBDeconstructData(data=deconstrsch.day_data)  # -> header, values; plug-in component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
panel_8 = Panel(xdata.values)
