# Grasshopper definition daylight_into_energy.gh (Grasshopper 1.0.7)

# ---- group: Opaque Faces
geo = Geometry([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])
roomsolid = HBRoomFromSolid(geo=flatten(geo), name="TestRoom", conditioned=True)  # -> report, rooms; plug-in component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

# ---- group: Apertures
# Geometry Preparation
panel = Panel("g_material")
glassmod = HBGlassModifier(name=panel, trans="0.55")  # -> modifier; plug-in component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
brep = Brep([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])
aperture = HBAperture(geo=brep, rad_mod=glassmod)  # -> report, apertures; plug-in component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
addsubface = HBAddSubface(hb_obj=flatten(roomsolid.rooms), sub_faces=flatten(aperture.apertures))  # -> report, hb_obj, unmatched; plug-in component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
bordershades = HBExtrudedBorderShades(hb_objs=flatten(addsubface.hb_obj), depth="0.3")  # -> report, hb_objs; plug-in component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

# ----
# Model + Grids
panel_2 = Panel("sample_model_grid")
model = HBModel(rooms=flatten(bordershades.hb_objs), name=panel_2)  # -> report, model; plug-in component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
gridrooms = HBSensorGridFromRooms(rooms=bordershades.hb_objs, grid_size="4")  # -> grid, points, mesh; plug-in component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
assigngridsviews = HBAssignGridsAndViews(model=model.model, grids=flatten(gridrooms.grid))  # -> model; plug-in component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
vizwiref = HBVisualizeWireframe(hb_objs=flatten(model.model))  # -> geo; plug-in component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
geo_2 = Geometry(gridrooms.points)

# ----
# Wea
panel_3 = Panel("https://energyplus-weather.s3.amazonaws.com/north_and_central_america_wmo_region_4/USA/MA/USA_MA_Boston-Logan.Intl.AP.725090_TMY3/USA_MA_Boston-Logan.Intl.AP.725090_TMY3.zip")
downloadepw = LBDownloadWeather(weather_URL=panel_3)  # -> epw_file, stat_file, ddy_file; plug-in component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
wea = HBWeaFromEPW(epw_file=downloadepw.epw_file)  # -> wea; plug-in component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

toggle = BooleanToggle(False)

# ----
# Run Recipe
panel_4 = Panel("Generic Office Occupancy")
annualdaylight = HBAnnualDaylight(model=assigngridsviews, wea=wea, schedule=panel_4, enhanced=Toggle(False), run=toggle)  # -> report, results, DA, cDA, UDI, UDI_low, UDI_up; plug-in component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

rooms = Data(bordershades.hb_objs)
daylightschedule = HBDaylightControlSchedule(results=flatten(annualdaylight.results), base_schedule="Generic Office Lighting", ill_setpoint=250)  # -> schedules; plug-in component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
gate = StreamGate(Stream=daylightschedule, Gate=toggle)  # -> Target0, Target1
applyroomsch = HBApplyRoomSchedules(room_or_program=flatten(rooms), lighting_sch=gate.Target1)  # -> report, mod_obj; plug-in component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
toggle_2 = BooleanToggle(False)
model_2 = HBModel(rooms=flatten(applyroomsch.mod_obj))  # -> report, model; plug-in component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
modeltoosm = HBModelToOSM(model=model_2.model, epw_file=downloadepw.epw_file, write=toggle_2, run=toggle_2)  # -> report, jsons, osw, osm, idf, sql, zsz, rdd, html; plug-in component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

roomenergyresult = HBReadRoomEnergyResult(sql=modeltoosm.sql)  # -> cooling, heating, lighting, electric_equip, gas_equip, process, hot_water, fan_electric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; plug-in component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
hourlyplot = LBHourlyPlot(data=roomenergyresult.lighting)  # -> report, mesh, legend, borders, labels, title, vis_set; plug-in component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
