# Grasshopper definition deconstructed_thermal_map.gh (Grasshopper 1.0.7)

# ----
# Create Rooms
interiorsurfaces = Geometry(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)
exteriorwall = Geometry([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])
exteriorwindows = Geometry([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])
aperture = HBAperture(geo=exteriorwindows)  # -> report, apertures; plug-in component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
face = HBFace(geo=exteriorwall)  # -> report, faces; plug-in component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
face_2 = HBFace(geo=interiorsurfaces, bc="Adiabatic")  # -> report, faces; plug-in component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
panel = Panel("2019::ClimateZone4::SteelFramed")
addsubface = HBAddSubface(hb_obj=flatten(face.faces), sub_faces=flatten(aperture.apertures))  # -> report, hb_obj, unmatched; plug-in component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
room = HBRoom(
    faces=flatten([face_2.faces, addsubface.hb_obj]),
    name="Office Shoe Box",
    constr_set=panel,
    program="2019::LargeOffice::OpenOffice",
    conditioned=True)  # -> report, room; plug-in component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

# ----
# Assign HVAC and Setpoints
doas = HBDOASHVACTemplates({"DOAS with fan coil chiller with boiler": "DOAS_FCU_Chiller_Boiler", "DOAS with fan coil chiller with central air source heat pump": "DOAS_FCU_Chiller_ASHP", "DOAS with fan coil chiller with district hot water": "DOAS_FCU_Chiller_DHW", "DOAS with fan coil chiller with baseboard electric": "DOAS_FCU_Chiller_ElectricBaseboard", "DOAS with fan coil chiller with gas unit heaters": "DOAS_FCU_Chiller_GasHeaters", "DOAS with fan coil chiller with no heat": "DOAS_FCU_Chiller", "DOAS with fan coil air-cooled chiller with boiler": "DOAS_FCU_ACChiller_Boiler", "DOAS with fan coil air-cooled chiller with central air source heat pump": "DOAS_FCU_ACChiller_ASHP", "DOAS with fan coil air-cooled chiller with district hot water": "DOAS_FCU_ACChiller_DHW", "DOAS with fan coil air-cooled chiller with baseboard electric": "DOAS_FCU_ACChiller_ElectricBaseboard"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}, selected="DOAS with fan coil chiller with boiler")
doashvac = HBDOASHVAC(rooms=flatten(room.room), system_type=doas, sensible_hr="0.8", latent_hr="0.75", dcv=Toggle(True))  # -> report, rooms; plug-in component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
applysetpointvals = HBApplySetpointValues(room_or_program=flatten(doashvac.rooms), cooling_setpt="24", heating_setpt="21")  # -> report, mod_obj; plug-in component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
model = HBModel(rooms=flatten(applysetpointvals.mod_obj))  # -> report, model; plug-in component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
vizwiref = HBVisualizeWireframe(hb_objs=flatten(model.model))  # -> geo; plug-in component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

construction_set = Data(panel)

# ----
# Energy Simulation
# Parameters
panel_2 = Panel("https://energyplus-weather.s3.amazonaws.com/north_and_central_america_wmo_region_4/USA/NY/USA_NY_New.York-J.F.Kennedy.Intl.AP.744860_TMY3/USA_NY_New.York-J.F.Kennedy.Intl.AP.744860_TMY3.zip")
downloadepw = LBDownloadWeather(weather_URL=panel_2)  # -> epw_file, stat_file, ddy_file; plug-in component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
importstat = LBImportSTAT(stat_file=downloadepw.stat_file)  # -> location, ashrae_zone, koppen_zone, clear_dir_norm_rad, clear_diff_horiz_rad, ann_heat_dday_996, ann_heat_dday_990, ann_cool_dday_004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; plug-in component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
item = ListItem(List=importstat.typical_weeks, Index=0, Wrap=True)  # -> Item, Item1, Item2, Item3
toggle = BooleanToggle(True)
simoutput = HBSimulationOutput(comfort_metrics=toggle, surface_temperature=toggle)  # -> report, sim_output; plug-in component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
simpar = HBSimulationParameter(output=simoutput.sim_output, run_period=item.Item3, timestep=6)  # -> sim_par; plug-in component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

# ----
# 1
toggle_2 = BooleanToggle(False)

# ----
# Window Transmittance
construction_set_2 = Data(construction_set)
decnstrconstrset = HBDeconstructConstructionSet(constr_set=construction_set_2)  # -> exterior_wall, exterior_roof, exposed_floor, ground_wall, ground_roof, ground_floor, window, skylight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; plug-in component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
decnstrconstr = HBDeconstructConstruction(constr=decnstrconstrset.window)  # -> materials, layers, r_val_si, r_val_ip, u_fac_si, u_fac_ip, shgc, t_sol, t_vis; plug-in component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
window_transmittance = Data(decnstrconstr.t_sol)

data = Data(model.model)

# ----
# EPW Solar Data
importepw = LBImportEPW(epw_file=downloadepw.epw_file)  # -> location, dry_bulb_temperature, dew_point_temperature, relative_humidity, wind_speed, wind_direction, direct_normal_rad, diffuse_horizontal_rad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; plug-in component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
data_2 = Data(item.Item3)
applyper = LBApplyAnalysisPeriod(data=importepw.diffuse_horizontal_rad, period=data_2)  # -> data; plug-in component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
applyper_2 = LBApplyAnalysisPeriod(data=importepw.direct_normal_rad, period=data_2)  # -> data; plug-in component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

# ----
# Run Energy Simuation!
modeltoosm = HBModelToOSM(model=model.model, epw_file=downloadepw.epw_file, sim_par=simpar, write=toggle_2, run=toggle_2)  # -> report, jsons, osw, osm, idf, sql, zsz, rdd, html; plug-in component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
faceresult = HBReadFaceResult(sql=modeltoosm.sql)  # -> face_indoor_temp, face_outdoor_temp, face_energy_flow; plug-in component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
roomcomfortresult = HBReadRoomComfortResult(sql=modeltoosm.sql)  # -> oper_temp, air_temp, rad_temp, rel_humidity, unmet_heat, unmet_cool; plug-in component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

end_hour = Panel("19")
start_hour = Panel("8")
subtraction = Subtraction(A=end_hour, B=start_hour)
series = Series(Start=start_hour, Step=1, Count=subtraction)

# ----
# Collect Opaque
# Geometry
facesbytype = HBFacesByType(hb_objs=model.model)  # -> walls, interior_walls, roofs, ceilings, exterior_floors, interior_floors, air_walls, apertures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; plug-in component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
data_3 = Data([facesbytype.walls, facesbytype.interior_walls, facesbytype.roofs, facesbytype.ceilings, facesbytype.exterior_floors, facesbytype.interior_floors])
vizquick = HBVisualizeQuick(hb_objs=flatten(data_3))  # -> geo; plug-in component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
join = BrepJoin(Breps=vizquick)  # -> Breps, Closed

# ----
# Load Surface Temperatures
colorfaces = HBColorFaces(data=flatten(faceresult.face_indoor_temp), hb_objs=flatten(data), sim_step=series)  # -> report, mesh, wire_frame, legend, title, faces, colors, values, vis_set; plug-in component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
branch = TreeBranch(Tree=simplify(colorfaces.faces), Path="{0}", MaintainPaths=True)
vizquick_2 = HBVisualizeQuick(hb_objs=branch)  # -> geo; plug-in component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

# ----
# Scroll Through Hours of the Day
hour_of_the_day = Slider(17, range=8..18)
# 2
toggle_3 = BooleanToggle(False)

# ----
# Calculate View Factors
comfortevalgeo = Geometry(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)
genpts = LBGeneratePointGrid(geometry=comfortevalgeo, grid_size="0.5", offset_dist="0")  # -> points, vectors, face_areas, mesh; plug-in component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
viewfactors = LBViewFactors(study_point=flatten(genpts.points), view_geo=flatten(vizquick_2), run=toggle_3)  # -> report, view_vecs, patch_mesh, view_factors, int_mtx; plug-in component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

opaque_geo = Geometry(join.Breps)
# 3
toggle_4 = BooleanToggle(False)

# ----
# Compute Longwave MRT
subtraction_2 = Subtraction(A=hour_of_the_day, B=start_hour)
branch_2 = TreeBranch(Tree=simplify(colorfaces.values), Path=subtraction_2, MaintainPaths=True)
multiplication = Multiplication(A=branch_2, B=viewfactors.view_factors)

# ----
# 4
toggle_5 = BooleanToggle(False)
ma = MassAddition(Input=multiplication)  # -> flatten(Result), PartialResults
# 5
toggle_6 = BooleanToggle(False)

# ----
# Account for Shortwave Solar
panel_3 = Panel("0, 0, -0.8")
move = Move(Geometry=genpts.points, Motion=panel_3)  # -> Geometry, Transform
humantosky = LBHumanToSkyRelation(location=importepw.location, position=flatten(move.Geometry), context=flatten(opaque_geo), pt_count="5", run=toggle_4)  # -> report, human_points, human_line, fract_body_exp, sky_exposure; plug-in component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

applyper_3 = LBApplyAnalysisPeriod(data=humantosky.fract_body_exp, period=data_2)  # -> data; plug-in component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

indoorsolarmrt = LBIndoorSolarMRT(
    location=importepw.location,
    longwave_mrt="20",
    dir_norm_rad=applyper_2,
    diff_horiz_rad=applyper,
    fract_body_exp=applyper_3,
    sky_exposure=humantosky.sky_exposure,
    window_trans=window_transmittance,
    run=toggle_5)  # -> report, erf, dmrt, mrt; plug-in component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
xdata = LBDeconstructData(data=indoorsolarmrt.dmrt)  # -> header, simplify(values); plug-in component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
item_2 = ListItem(List=xdata.values, Index=subtraction_2, Wrap=True)  # -> flatten(Item)
addition = Addition(A=item_2, B=ma.Result)

# ----
# Calculate PMV Comfort
xdata_2 = LBDeconstructData(data=roomcomfortresult.rel_humidity)  # -> header, values; plug-in component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
xdata_3 = LBDeconstructData(data=roomcomfortresult.air_temp)  # -> header, values; plug-in component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
item_3 = ListItem(List=xdata_2.values, Index=hour_of_the_day, Wrap=True)
item_4 = ListItem(List=xdata_3.values, Index=hour_of_the_day, Wrap=True)
pmv = LBPMVComfort(air_temp=item_4, mrt=addition, rel_humid=item_3, met_rate="1.1", clothing="0.6", run=toggle_6)  # -> report, pmv, ppd, set, comfort, condition, heat_loss, comf_obj; plug-in component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

# ----
# Visualize Spatial Comfort
panel_4 = Panel("8")
colrange = LBColorRange(index=panel_4)  # -> colors; plug-in component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
legendpar = LBLegendParameters(min="-1", max="1", colors=colrange)  # -> leg_par; plug-in component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
mesh = Mesh(genpts.mesh)
heatmap = LBSpatialHeatmap(values=pmv.pmv, mesh=mesh, legend_par=legendpar, legend_title="PMV", global_title="Thermal Comfort")  # -> mesh, legend, title, colors, legend_par, vis_set; plug-in component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
