# Grasshopper definition outdoor_comfort_under_a_tree.gh (Grasshopper 1.0.7)

tree_canopy = Brep(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)
asphalt_zone = Brep(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)
soil_zone = Brep(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)
python = GhPythonScript(st_month="5", end_month="11")  # -> values; inputs st_month: Int32, end_month: Int32
# ---------- python: Python ----------
from ladybug.analysisperiod import AnalysisPeriod


winter_value = 0.8
summer_value = 0
trans_hours = 1000
increment = (winter_value - summer_value) / trans_hours


if st_month and end_month:
    values = [winter_value] * 8760
    a_per = AnalysisPeriod(st_month=st_month, end_month=end_month)
    insert_list = [summer_value] * len(a_per)
    v_i = summer_value
    for i in range(trans_hours):
        insert_list[i] = winter_value - v_i
        insert_list[-i - 1] = winter_value - v_i
        v_i += increment
    values[a_per.st_time.int_hoy - 1:a_per.end_time.int_hoy] = insert_list
# ---------- end python ----------
roomsolid = HBRoomFromSolid(geo=flatten(asphalt_zone), name="Asphalt", conditioned=True)  # -> report, rooms; plug-in component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
roomsolid_2 = HBRoomFromSolid(geo=flatten(soil_zone), name="Soil", conditioned=True)  # -> report, rooms; plug-in component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
fixedintervalschedule = HBFixedIntervalSchedule(values=python, name="Deciduous Tree Trans")  # -> report, schedule; plug-in component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
panel = Panel("""Grassy Lawn
Asphalt Pavement""")
shade = HBShade(geo=tree_canopy)  # -> report, shades; plug-in component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
ground = HBGround(rooms=[roomsolid_2.rooms, roomsolid.rooms], soil_constr=panel)  # -> rooms; plug-in component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
model = HBModel(rooms=flatten(ground), shades=flatten(shade.shades))  # -> report, model; plug-in component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
vizwiref = HBVisualizeWireframe(hb_objs=flatten(model.model))  # -> geo; plug-in component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

evaluation_surface = Brep([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])
genpts = LBGeneratePointGrid(geometry=evaluation_surface, grid_size="0.5")  # -> points, vectors, face_areas, graft(mesh); plug-in component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
sensorgrid = HBSensorGrid(positions=genpts.points, directions=genpts.vectors)  # -> grid; plug-in component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
assigngridsviews = HBAssignGridsAndViews(model=model.model, grids=flatten(sensorgrid))  # -> model; plug-in component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

panel_2 = Panel("https://energyplus-weather.s3.amazonaws.com/north_and_central_america_wmo_region_4/USA/NY/USA_NY_New.York-J.F.Kennedy.Intl.AP.744860_TMY3/USA_NY_New.York-J.F.Kennedy.Intl.AP.744860_TMY3.zip")
downloadepw = LBDownloadWeather(weather_URL=panel_2)  # -> epw_file, stat_file, ddy_file; plug-in component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
importstat = LBImportSTAT(stat_file=downloadepw.stat_file)  # -> location, ashrae_zone, koppen_zone, clear_dir_norm_rad, clear_diff_horiz_rad, ann_heat_dday_996, ann_heat_dday_990, ann_cool_dday_004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; plug-in component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

panel_3 = Panel("""0
0
0
0
0
0
0
0
1
1
1
1
1
1
1
1
1
1
1
1
0
0
0
0""")
constrheader = LBConstructHeader(data_type="Fraction", a_period=importstat.extreme_hot_week)  # -> header; plug-in component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
dup = DuplicateData(Data=panel_3, Number="7", Order=True)
data = LBConstructData(header=constrheader, values=dup)  # -> data; plug-in component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

utcimap = HBUTCIComfortMap(
    model=assigngridsviews,
    epw=downloadepw.epw_file,
    run_period=importstat.extreme_hot_week,
    schedule=data,
    run=Toggle(False))  # -> report, env_conds, utci, condition, category, TCP, HSP, CSP; plug-in component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

colrange = LBColorRange(index="10")  # -> colors; plug-in component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
legendpar = LBLegendParameters(colors=colrange, num_decimals="0", vert_or_horiz=Toggle(False))  # -> leg_par; plug-in component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
mjoin = MeshJoin(Meshes=flatten(genpts.mesh))
heatmap = LBSpatialHeatmap(values=flatten(utcimap.HSP), mesh=mjoin, legend_par=legendpar, legend_title="Extreme Hot Week Heat Sensation (%)")  # -> mesh, legend, title, colors, legend_par, vis_set; plug-in component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
legend2d = LBLegend2DParameters()  # -> leg_par2d; plug-in component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
visset = LBPreviewVisualizationSet(vis_set=flatten(heatmap.vis_set), leg_par2d=legend2d)  # -> vs; plug-in component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
