# Grasshopper definition outfoor_comfort_under_a_tree.gh (Grasshopper 1.0.7)

tree_canopy = Brep(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)
asphalt_zone = Brep(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)
soil_zone = Brep(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)
roomsolid = HBRoomFromSolid(geo=flatten(asphalt_zone), name="Asphalt", conditioned=True)  # -> report, rooms; plug-in component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
roomsolid_2 = HBRoomFromSolid(geo=flatten(soil_zone), name="Soil", conditioned=True)  # -> report, rooms; plug-in component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
shade = HBShade(geo=tree_canopy)  # -> report, shades; plug-in component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
ground = HBGround(rooms=roomsolid.rooms, soil_constr="Asphalt Pavement")  # -> rooms; plug-in component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
ground_2 = HBGround(rooms=roomsolid_2.rooms, soil_constr="Moist Soil")  # -> rooms; plug-in component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
model = HBModel(rooms=flatten([ground_2, ground]), shades=flatten(shade.shades))  # -> report, model; plug-in component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

evaluation_surface = Brep([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])
genpts = LBGeneratePointGrid(geometry=evaluation_surface, grid_size="0.5")  # -> points, vectors, face_areas, graft(mesh); plug-in component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
sensorgrid = HBSensorGrid(positions=genpts.points, directions=genpts.vectors)  # -> grid; plug-in component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
assigngridsviews = HBAssignGridsAndViews(model=model.model, grids=flatten(sensorgrid))  # -> model; plug-in component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

panel = Panel("https://energyplus-weather.s3.amazonaws.com/north_and_central_america_wmo_region_4/USA/NY/USA_NY_New.York-J.F.Kennedy.Intl.AP.744860_TMY3/USA_NY_New.York-J.F.Kennedy.Intl.AP.744860_TMY3.zip")
downloadepw = LBDownloadWeather(weather_URL=panel)  # -> epw_file, stat_file, ddy_file; plug-in component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
importstat = LBImportSTAT(stat_file=downloadepw.stat_file)  # -> location, ashrae_zone, koppen_zone, clear_dir_norm_rad, clear_diff_horiz_rad, ann_heat_dday_996, ann_heat_dday_990, ann_cool_dday_004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; plug-in component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

faceenergyattr = HBFaceEnergyAttributes({"Construction": "properties.energy.construction.display_name", "Materials": "properties.energy.construction.layers", "Thickness [m]": "properties.energy.construction.thickness", "Density [kg/m2]": "properties.energy.construction.mass_area_density", "Heat Capacity [kg/K-m2]": "properties.energy.construction.area_heat_capacity", "R-Value [m2-K/W]": "properties.energy.construction.r_value", "U-Value [W/m2-K]": "properties.energy.construction.u_value", "U-Factor [W/m2-K]": "properties.energy.construction.u_factor", "SHGC [Unshaded]": "properties.energy.construction.shgc", "Solar Transmitance [Unshaded]": "properties.energy.construction.solar_transmittance", "Visible Transmitance [Unshaded]": "properties.energy.construction.visible_transmittance", "Solar Reflectance [Outside]": "properties.energy.construction.outside_solar_reflectance", "Solar Reflectance [Inside]": "properties.energy.construction.inside_solar_reflectance", "Fraction Area Operable": "properties.energy.vent_opening.fraction_area_operable", "Fraction Height Operable": "properties.energy.vent_opening.fraction_height_operable", "Discharge Coefficient": "properties.energy.vent_opening.discharge_coefficient"}, selected="Solar Reflectance [Outside]")
vizwiref = HBVisualizeWireframe(hb_objs=flatten(model.model))  # -> geo; plug-in component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
colorfaceattr = HBColorFaceAttributes(hb_objs=flatten(model.model), attribute=faceenergyattr)  # -> mesh, legend, wire_frame, values, colors; plug-in component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
utcimap = HBUTCIComfortMap(
    model=assigngridsviews,
    epw=downloadepw.epw_file,
    ddy=downloadepw.ddy_file,
    run_period=importstat.extreme_hot_week,
    run=Toggle(False))  # -> report, utci, condition, category, TCP, HSP, CSP; plug-in component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

colrange = LBColorRange(index="10")  # -> colors; plug-in component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
legendpar = LBLegendParameters(min="45", max="55", colors=colrange, num_decimals="0")  # -> leg_par; plug-in component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
heatmap = LBSpatialHeatmap(
    values=utcimap.HSP,
    mesh=genpts.mesh,
    legend_par=legendpar,
    legend_title="%",
    global_title="Extreme Hot Week Heat Sensation")  # -> mesh, legend, title, colors, legend_par; plug-in component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
