# Grasshopper definition passive_construction_set.gh (Grasshopper 1.0.7)

searchconstrs = HBSearchConstructions(keywords="Exterior Mass Wall")  # -> opaque_constrs, window_constrs, shade_constrs; plug-in component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
panel = Panel(searchconstrs.opaque_constrs)

searchmats = HBSearchMaterials(keywords="8IN Concrete HW")  # -> opaque_mats, window_mats; plug-in component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
panel_2 = Panel(searchmats.opaque_mats)
item = ListItem(List=panel_2, Index="1", Wrap=True)
decnstrmat = HBDeconstructMaterial(mat=item)  # -> values, attr_names, r_val_si, r_val_ip; plug-in component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
panel_3 = Panel(decnstrmat.values)
panel_4 = Panel(decnstrmat.attr_names)

opaquemat = HBOpaqueMaterial(name="Adobe Brick", thickness="0.2", conductivity="0.5", density="1600", spec_heat="1200", sol_absp="0.6")  # -> mat; plug-in component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
opaqueconstr = HBOpaqueConstruction(name="Mass Wall", materials=opaquemat)  # -> constr; plug-in component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
interiorsubset = HBInteriorConstructionSubset(interior_wall=opaqueconstr)  # -> interior_set; plug-in component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

merge = Merge(
    Data1="Generic Low-e Glass",
    Data2="Generic Window Argon Gap",
    Data3="Generic Low-e Glass",
    Data4="Generic Window Argon Gap",
    Data5="Generic Clear Glass")
windowconstr = HBWindowConstruction(name="Triple Pane", materials=merge)  # -> constr; plug-in component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

subfacesubset = HBSubfaceSubset(window=windowconstr, skylight=windowconstr, operable=windowconstr)  # -> subface_set; plug-in component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
decnstrconstr = HBDeconstructConstruction(constr=windowconstr)  # -> materials, layers, r_val_si, r_val_ip, u_fac_si, u_fac_ip, shgc, t_sol, t_vis; plug-in component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
panel_5 = Panel(decnstrconstr.shgc)
panel_6 = Panel(decnstrconstr.u_fac_si)

applyloadvals = HBApplyLoadValues(room_or_program=flatten("2019::MidriseApartment::Apartment"), infilt_per_exterior="0.0001")  # -> report, mod_obj; plug-in component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

constructionset = HBConstructionSet(
    name="Passive Building Climate Zone 3",
    base_constr_set="2019::ClimateZone3::Mass",
    interior_subset=interiorsubset,
    subface_subset=subfacesubset)  # -> constr_set; plug-in component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

objtostr = HBObjectToString(hb_obj=applyloadvals.mod_obj)  # -> hb_str; plug-in component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

decnstrconstrset = HBDeconstructConstructionSet(constr_set=constructionset)  # -> exterior_wall, exterior_roof, exposed_floor, ground_wall, ground_roof, ground_floor, window, skylight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; plug-in component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
decnstrconstr_2 = HBDeconstructConstruction(constr=decnstrconstrset.exterior_wall)  # -> materials, layers, r_val_si, r_val_ip, u_fac_si, u_fac_ip, shgc, t_sol, t_vis; plug-in component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
panel_7 = Panel(decnstrconstr_2.r_val_si)
panel_8 = Panel(decnstrconstr_2.materials)
panel_9 = Panel(decnstrconstr_2.u_fac_si)
panel_10 = Panel(decnstrconstr_2.shgc)

objtostr_2 = HBObjectToString(hb_obj=constructionset)  # -> hb_str; plug-in component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
