# Grasshopper definition shoe_box_annual_loads.gh (Grasshopper 1.0.7)

# ----
# Create Shoe Box
panel = Panel("10")
box = DomainBox(Base=PlaneXY(0, 0, 0), X="10", Y=panel, Z="3")
debrep = DeconstructBrep(Brep=box)  # -> Faces, Edges, Vertices
panel_2 = Panel("""0
1
3
4
5""")
item = ListItem(List=debrep.Faces, Index="2", Wrap=True)
item_2 = ListItem(List=debrep.Faces, Index=panel_2, Wrap=True)

# ---- group: Chage Glazing Ratio, Orientation, and Program
window_ratio = Slider(0.4, range=0.1..0.9)
orientation = Slider(1, range=0..8, expression="x * 45")
hospital_programs = Slider(7, range=0..20)

# ----
# Browse Programs
bldgprograms = HBBuildingPrograms({"LargeOffice", "MediumOffice", "SmallOffice", "MidriseApartment", "HighriseApartment", "Retail", "StripMall", "PrimarySchool", "SecondarySchool", "SmallHotel", "LargeHotel", "Hospital", "Outpatient", "Laboratory", "Warehouse", "SuperMarket", "FullServiceRestaurant", "QuickServiceRestaurant", "Courthouse", "LargeDataCenterHighITE", "LargeDataCenterLowITE", "SmallDataCenterHighITE", "SmallDataCenterLowITE"}, selected="Hospital")
searchprog = HBSearchPrograms(bldg_prog=bldgprograms)  # -> room_prog; plug-in component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
panel_3 = Panel(searchprog)
item_3 = ListItem(List=searchprog, Index=hospital_programs, Wrap=True)
panel_4 = Panel(item_3)

# ----
# Create Honeybee Room
panel_5 = Panel("outdoors")
geo = Geometry(item)
geo_2 = Geometry(item_2)
face = HBFace(geo=geo, bc=panel_5)  # -> report, faces; plug-in component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
face_2 = HBFace(geo=geo_2, bc="adiabatic")  # -> report, faces; plug-in component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
aperturesbyratio = HBAperturesByRatio(hb_objs=flatten(face.faces), ratio=window_ratio, subdivide=Toggle(False))  # -> report, hb_objs; plug-in component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
room = HBRoom(
    faces=flatten([face_2.faces, aperturesbyratio.hb_objs]),
    name="Hospital Shoe Box",
    constr_set="2013::ClimateZone5::SteelFramed",
    program=item_3,
    conditioned=True)  # -> report, room; plug-in component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
rotate = HBRotate(hb_objs=flatten(room.room), angle=orientation)  # -> hb_objs; plug-in component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

# ----
# Download EPW File
panel_6 = Panel("https://energyplus-weather.s3.amazonaws.com/north_and_central_america_wmo_region_4/USA/MA/USA_MA_Boston-Logan.Intl.AP.725090_TMY3/USA_MA_Boston-Logan.Intl.AP.725090_TMY3.zip")
downloadepw = LBDownloadWeather(weather_URL=panel_6)  # -> epw_file, stat_file, ddy_file; plug-in component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

# ---- group: Run Me!
toggle = BooleanToggle(False)

# ----
annualloads = HBAnnualLoads(rooms=rotate, epw_file=downloadepw.epw_file, run_bal=toggle, run=toggle)  # -> report, total_load, cooling, heating, lighting, equip, hot_water, balance; plug-in component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

# ----
# Visualize Room
vizbytype = HBVisualizeByType(hb_objs=rotate)  # -> walls, interior_walls, roofs, ceilings, exterior_floors, interior_floors, air_walls, apertures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; plug-in component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

# ----
# Evaluate Total Load
ma = MassAddition(Input=annualloads.total_load)  # -> Result, PartialResults
panel_7 = Panel(annualloads.total_load)
panel_8 = Panel("""cooling
heating
lighting
equipment""")
total_load_intensity_kwh_m2 = Panel(ma.Result)

data = Data(flatten([annualloads.cooling, annualloads.heating, annualloads.lighting, annualloads.equip, annualloads.hot_water]))

# ----
# Visualize Monthly Load
monthly_loads = Data(data)
legendpar = LBLegendParameters(
    max="30",
    colors=[ColourSwatch(SwatchColor=RGB(4, 25, 145)), ColourSwatch(SwatchColor=RGB(153, 16, 0)), ColourSwatch(SwatchColor=RGB(255, 255, 0)), ColourSwatch(SwatchColor=RGB(255, 121, 0))],
    num_decimals="0",
    text_height="2")  # -> leg_par; plug-in component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
monthlychart = LBMonthlyChart(data=monthly_loads, base_pt="40,0,0", stack=Toggle(True), legend_par=legendpar)  # -> report, data_mesh, data_lines, col_lines, legend, borders, labels, y_title, title; plug-in component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
item_4 = ListItem(List=monthlychart.legend, Index=0, Wrap=True)
medges = MeshEdges(Mesh=[monthlychart.data_mesh, item_4])  # -> NakedEdges, InteriorEdges, NonManifoldEdges

# ----
# Visualize Load Balance
panel_9 = Panel("19")
monthly_loads_2 = Data(annualloads.balance)
colrange = LBColorRange(index=panel_9)  # -> colors; plug-in component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
neg = Negative(Value="30")
legendpar_2 = LBLegendParameters(min=neg, max="30", colors=colrange, num_decimals="0", text_height="2")  # -> leg_par; plug-in component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
monthlychart_2 = LBMonthlyChart(data=monthly_loads_2, base_pt="40,-90,0", y_dim="80", stack=Toggle(True), legend_par=legendpar_2)  # -> report, data_mesh, data_lines, col_lines, legend, borders, labels, y_title, title; plug-in component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
item_5 = ListItem(List=monthlychart_2.legend, Index=0, Wrap=True)
medges_2 = MeshEdges(Mesh=[monthlychart_2.data_mesh, item_5])  # -> NakedEdges, InteriorEdges, NonManifoldEdges
