# Grasshopper definition shoe_box_energy_model.gh (Grasshopper 1.0.7)

# ---- group: Dynamically Chage Glazing Ratio
number_slider = Slider(0.4, range=-0.1..0.9)

# ----
# Create Honeybee Model
panel = Panel("outdoors")
geo = Geometry([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])
geo_2 = Geometry(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)
face = HBFace(geo=geo, bc=panel)  # -> report, faces; plug-in component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
face_2 = HBFace(geo=geo_2, bc="adiabatic")  # -> report, faces; plug-in component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
aperturesbyratio = HBAperturesByRatio(hb_objs=flatten(face.faces), ratio=number_slider)  # -> report, hb_objs; plug-in component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
all_air = HBAllAirHVACTemplates({"VAV chiller with gas boiler reheat", "VAV chiller with central air source heat pump reheat", "VAV chiller with district hot water reheat", "VAV chiller with PFP boxes", "VAV chiller with gas coil reheat", "VAV air-cooled chiller with gas boiler reheat", "VAV air-cooled chiller with central air source heat pump reheat", "VAV air-cooled chiller with district hot water reheat", "VAV air-cooled chiller with PFP boxes", "VAV air-cooled chiller with gas coil reheat"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}, selected="VAV chiller with gas boiler reheat")
room = HBRoom(
    faces=flatten([face_2.faces, aperturesbyratio.hb_objs]),
    name="Office Shoe Box",
    constr_set="2013::ClimateZone5::SteelFramed",
    program="2013::LargeOffice::OpenOffice",
    conditioned=True)  # -> report, room; plug-in component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
panel_2 = Panel("DifferentialDryBulb")
concat = Concatenate(FragmentA="ShoeBox", FragmentB=number_slider)
allairhvac = HBAllAirHVAC(rooms=flatten(room.room), system_type=all_air, name="VAV System")  # -> report, rooms; plug-in component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
model = HBModel(rooms=flatten(allairhvac.rooms), name=concat)  # -> report, model; plug-in component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

# ----
# Request Outputs
toggle = BooleanToggle(True)
simoutput = HBSimulationOutput(zone_energy_use=toggle, hvac_energy_use=toggle)  # -> report, sim_output; plug-in component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
simpar = HBSimulationParameter(output=simoutput.sim_output, timestep=6)  # -> sim_par; plug-in component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

# ----
# Download EPW File
panel_3 = Panel("https://www.energyplus.net/weather-download/north_and_central_america_wmo_region_4/USA/MA/USA_MA_Boston-Logan.Intl.AP.725090_TMY3/all")
downloadepw = LBDownloadWeather(weather_URL=panel_3)  # -> epw_file, stat_file, ddy_file; plug-in component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

vizbytype = HBVisualizeByType(hb_objs=model.model)  # -> walls, interior_walls, roofs, ceilings, exterior_floors, interior_floors, air_walls, apertures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; plug-in component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
connect_to_run__to_only_write_idf = Panel("2")
toggle_2 = BooleanToggle(False)
modeltoosm = HBModelToOSM(model=model.model, epw_file=downloadepw.epw_file, sim_par=simpar, write=toggle_2, run=toggle_2)  # -> report, jsons, osw, osm, idf, sql, zsz, rdd, html; plug-in component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

# ----
# Visualize Results
roomenergyresult = HBReadRoomEnergyResult(sql=modeltoosm.sql)  # -> cooling, heating, lighting, electric_equip, gas_equip, fan_electric, pump_electric, people_gain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; plug-in component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
hourlyplot = LBHourlyPlot(data=[roomenergyresult.cooling, roomenergyresult.heating, roomenergyresult.fan_electric, roomenergyresult.pump_electric])  # -> report, mesh, legend, borders, labels, title; plug-in component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

# ----
# Optionally Execute Simulations in Parallel
data = Data(modeltoosm.osw)
data_2 = Data(modeltoosm.idf)
data_3 = Data(downloadepw.epw_file)
rec = DataRecorder(data, DataLimit=-10, RecordData=True)
rec_2 = DataRecorder(data_2, DataLimit=-10, RecordData=True)
toggle_3 = BooleanToggle(False)
runidf = HBRunIDF(idf=rec_2, epw_file=data_3, parallel=Toggle(True), run=Toggle(False))  # -> report, sql, zsz, rdd, html; plug-in component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
runosw = HBRunOSW(osw=rec, epw_file=data_3, parallel=Toggle(True), translate=toggle_3, run=toggle_3)  # -> report, osm, idf, sql, zsz, rdd, html; plug-in component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
