# Grasshopper definition simple_natural_ventilation.gh (Grasshopper 1.0.7)

number_slider = Slider(0.6, range=0..1)
# Set Up The Geometry
adiabatic_srfs1 = Brep(graft([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]))
adiabatic_srfs2 = Brep(graft([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]))
adiabatic_srfs3 = Brep(graft([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]))
airwalls1 = Brep(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)
airwalls2 = Brep([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])
airwalls3 = Brep(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)
interiorpartition1 = Brep(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)
interiorpartition2 = Brep(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)
south_facade = Brep(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)
north_facade = Brep(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)
toggle = BooleanToggle(True)
face = HBFace(geo=north_facade, name="North Wall")  # -> report, faces; plug-in component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
flip = FlipMatrix(Data=[adiabatic_srfs1, adiabatic_srfs2, adiabatic_srfs3])  # -> simplify(Data)
face_2 = HBFace(geo=graft([interiorpartition1, interiorpartition2]))  # -> report, faces; plug-in component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
face_3 = HBFace(geo=graft([airwalls1, airwalls2, airwalls3]), type="AirBoundary")  # -> report, faces; plug-in component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
face_4 = HBFace(geo=flip, bc="Adiabatic")  # -> report, faces; plug-in component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
face_5 = HBFace(geo=south_facade, name="South Wall")  # -> report, faces; plug-in component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
bang = ExplodeTree(Data=face_4.faces)  # -> Branch0, Branch1, Branch2
bang_2 = ExplodeTree(Data=face_2.faces)  # -> Branch0, Branch1
bang_3 = ExplodeTree(Data=simplify(face_3.faces))  # -> Branch0, Branch1, Branch2, Branch3
aperturesbyratio = HBAperturesByRatio(hb_objs=flatten(face_5.faces), ratio=number_slider, operable=toggle)  # -> report, hb_objs; plug-in component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
aperturesbyratio_2 = HBAperturesByRatio(hb_objs=flatten(face.faces), ratio=number_slider, operable=toggle)  # -> report, hb_objs; plug-in component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
data = Data(flatten([bang_3.Branch1, bang_3.Branch2]))

panel = Panel(" ")

panel_3 = Panel("https://energyplus-weather.s3.amazonaws.com/north_and_central_america_wmo_region_4/USA/CA/USA_CA_Burbank-Glendale-Passadena.Bob.Hope.AP.722880_TMY3/USA_CA_Burbank-Glendale-Passadena.Bob.Hope.AP.722880_TMY3.zip")
simoutput = HBSimulationOutput(comfort_metrics=Toggle(True))  # -> report, sim_output; plug-in component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
simpar = HBSimulationParameter(output=simoutput.sim_output, timestep=6)  # -> sim_par; plug-in component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
downloadepw = LBDownloadWeather(weather_URL=panel_3)  # -> epw_file, stat_file, ddy_file; plug-in component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

bldgprograms = HBBuildingPrograms({"LargeOffice", "MediumOffice", "SmallOffice", "MidriseApartment", "HighriseApartment", "Retail", "StripMall", "PrimarySchool", "SecondarySchool", "SmallHotel", "LargeHotel", "Hospital", "Outpatient", "Laboratory", "Warehouse", "SuperMarket", "FullServiceRestaurant", "QuickServiceRestaurant", "Courthouse", "College", "LargeDataCenterHighITE", "LargeDataCenterLowITE", "SmallDataCenterHighITE", "SmallDataCenterLowITE"}, selected="MidriseApartment")
toggle_2 = BooleanToggle(False)
searchprog = HBSearchPrograms(bldg_prog=bldgprograms)  # -> room_prog; plug-in component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
# Apply Properties for an Energy Simulation
panel_4 = Panel("Room_1")
item = ListItem(List=searchprog, Index=0, Wrap=True)
room = HBRoom(faces=flatten([bang.Branch1, data, bang_2.Branch1]), name="Room_2", program=item, conditioned=toggle_2)  # -> report, room; plug-in component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
room_2 = HBRoom(
    faces=flatten([aperturesbyratio.hb_objs, bang_3.Branch0, bang.Branch0, bang_2.Branch0]),
    name=panel_4,
    program=item,
    conditioned=toggle_2)  # -> report, room; plug-in component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
room_3 = HBRoom(
    faces=flatten([bang.Branch2, bang_3.Branch3, aperturesbyratio_2.hb_objs]),
    name="Room_3",
    program=item,
    conditioned=toggle_2)  # -> report, room; plug-in component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

id = HBSetIdentifier(hb_obj=room.room, id="Room_2")  # -> hb_obj; plug-in component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
id_2 = HBSetIdentifier(hb_obj=room_2.room, id=panel_4)  # -> hb_obj; plug-in component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
id_3 = HBSetIdentifier(hb_obj=room_3.room, id="Room_3")  # -> hb_obj; plug-in component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

solveadj = HBSolveAdjacency(rooms=flatten([id_2, id, id_3]), run=Toggle(True))  # -> report, adj_rooms; plug-in component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

vizbytype = HBVisualizeByType(hb_objs=solveadj.adj_rooms)  # -> walls, interior_walls, roofs, ceilings, exterior_floors, interior_floors, air_walls, apertures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; plug-in component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
geo = Geometry([vizbytype.wire_frame, vizbytype.air_walls, vizbytype.apertures, vizbytype.interior_apertures])

# ----
# 1) AutoCalulated Window-Based Natural Ventilation
panel_5 = Panel("22")
ventcontrol = HBVentilationControl(min_in_temp=panel_5, max_out_temp="28")  # -> vent_cntrl; plug-in component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
# POSSIBLE NAT
# VENT OPTIONS
windowopen = HBWindowOpening(rooms=flatten(solveadj.adj_rooms), vent_cntrl=ventcontrol)  # -> report, rooms; plug-in component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
faceenergyattr = HBFaceEnergyAttributes({"Construction": "properties.energy.construction.display_name", "Materials": "properties.energy.construction.layers", "Thickness [m]": "properties.energy.construction.thickness", "Density [kg/m2]": "properties.energy.construction.mass_area_density", "Heat Capacity [J/K-m2]": "properties.energy.construction.area_heat_capacity", "Construction R-Value [m2-K/W]": "properties.energy.construction.r_value", "Construction U-Value [W/m2-K]": "properties.energy.construction.u_value", "Construction U-Factor [W/m2-K]": "properties.energy.construction.u_factor", "Construction SHGC [Unshaded]": "properties.energy.construction.shgc", "R-Factor [m2-K/W]": "properties.energy.r_factor", "U-Factor [W/m2-K]": "properties.energy.u_factor", "SHGC [Unshaded]": "properties.energy.shgc", "Solar Transmitance [Unshaded]": "properties.energy.construction.solar_transmittance", "Visible Transmitance [Unshaded]": "properties.energy.construction.visible_transmittance", "Solar Reflectance [Outside]": "properties.energy.construction.outside_solar_reflectance", "Solar Reflectance [Inside]": "properties.energy.construction.inside_solar_reflectance", "Fraction Area Operable": "properties.energy.vent_opening.fraction_area_operable", "Fraction Height Operable": "properties.energy.vent_opening.fraction_height_operable", "Discharge Coefficient": "properties.energy.vent_opening.discharge_coefficient"}, selected="Fraction Area Operable")
lablefaces = HBLabelFaces(hb_objs=flatten(windowopen.rooms), attribute=faceenergyattr, sub_faces=Toggle(True))  # -> label_text, base_pts, labels, wire_frame; plug-in component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

# ----
# 2) Fan-Driven With Night Flush Shcedule
panel_6 = Panel("""1
1
1
1
1
1
1
0
0
0
0
0
0
0
0
0
0
0
0
0
0
1
1
1""")
constantschedule = HBConstantSchedule(values=panel_6, name="Night Flush Schedule")  # -> report, schedule, idf_text; plug-in component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
ventcontrol_2 = HBVentilationControl(min_in_temp="18", schedule=constantschedule.schedule)  # -> vent_cntrl; plug-in component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
fanvent = HBFanVentilation(rooms=flatten(solveadj.adj_rooms), flow_rate="0.5", vent_cntrl=ventcontrol_2)  # -> report, rooms; plug-in component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

min_indoor_temperature_c = Panel("20")
chimney_height_m = Panel("3")
max_outdoor_temperature_c = Panel("28")
# 3) Custom Chimney Object
base_idf_string = Panel("""ZoneVentilation:WindandStackOpenArea,
    Room 2 Custom Chimney,   !- Name
    {0},                     !- Zone or Space Name
    {1},                     !- Opening Area m2
    ,                        !- Opening Area Fraction Schedule Name
    0,                       !- Opening Effectiveness dimensionless
    ,                        !- Effective Angle deg
    {2},                     !- Height Difference m
    0.65,                    !- Discharge Coefficient for Opening
    {3},                     !- Minimum Indoor Temperature C
    ,                        !- Minimum Indoor Temperature Schedule Name
    100,                     !- Maximum Indoor Temperature C
    ,                        !- Maximum Indoor Temperature Schedule Name
    -100,                    !- Delta Temperature deltaC
    ,                        !- Delta Temperature Schedule Name
    -100,                    !- Minimum Outdoor Temperature C
    ,                        !- Minimum Outdoor Temperature Schedule Name
    {4},                     !- Maximum Outdoor Temperature C
    ,                        !- Maximum Outdoor Temperature Schedule Name
    40;                      !- Maximum Wind Speed m/s""")
chimney_open_area_m2 = Panel("1")
room_id = Data("Room_2")
format = Format(
    Format=base_idf_string,
    Culture=127,
    Data0=room_id,
    Data1=chimney_open_area_m2,
    Data2=chimney_height_m,
    Data3=min_indoor_temperature_c,
    Data4=max_outdoor_temperature_c)

# ----
# Run the Simulation
additional_idf_strings = Data()
# Run the Energy Simulation
toggle_3 = BooleanToggle(False)
model = HBModel(rooms=flatten(windowopen.rooms), name="NatVentExample")  # -> report, model; plug-in component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
modeltoosm = HBModelToOSM(
    model=model.model,
    epw_file=downloadepw.epw_file,
    sim_par=simpar,
    add_str=additional_idf_strings,
    write=toggle_3,
    run=toggle_3)  # -> report, jsons, osw, osm, idf, sql, zsz, rdd, html; plug-in component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
