# Grasshopper definition single_family_earth_tube.gh (Grasshopper 1.0.7)

# ----
# Setup Model
geo = Geometry([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])
toggle = BooleanToggle(True)
intsolid = HBIntersectSolids(rooms=flatten(geo), run=toggle)  # -> int_rooms; plug-in component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
geo_2 = Geometry([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])
aperture = HBAperture(geo=geo_2, operable=Toggle(True))  # -> report, apertures; plug-in component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
roomsolid = HBRoomFromSolid(
    geo=flatten(intsolid),
    name="Residence",
    constr_set="2004::ClimateZone3::SteelFramed",
    program="2019::MidriseApartment::Apartment",
    conditioned=Toggle(False))  # -> report, rooms; plug-in component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
bordershades = HBExtrudedBorderShades(hb_objs=flatten(aperture.apertures), depth="0.3")  # -> report, hb_objs; plug-in component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
addsubface = HBAddSubface(hb_obj=flatten(roomsolid.rooms), sub_faces=flatten(bordershades.hb_objs))  # -> report, hb_obj, unmatched; plug-in component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
solveadj = HBSolveAdjacency(rooms=flatten(addsubface.hb_obj), run=toggle)  # -> report, adj_rooms; plug-in component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
house_rooms = Data(flatten(solveadj.adj_rooms))

# ----
# Add Earth Tubes
panel = Panel("""ZoneEarthtube,
  ***room***,           !- Zone Name
  ETSch, !- Schedule Name
  3.425198,         !- Design Volume Flow Rate
  16.0,             !- Minimum Zone Temperature when Cooling
  30.0,             !- Maximum Zone Temperature when Heating
  1.0,              !- Delta Temperature
  intake,          !- EarthTube Type
  350.0,            !- Fan Pressure Rise
  0.9,              !- Fan Total Efficiency
  0.25,             !- Pipe Radius
  0.2,              !- Pipe Thickness
  150.0,             !- Pipe Length
  200.0,            !- Pipe Thermal Conductivity
  3.5,              !- Pipe Depth Under Ground Surface
  HeavyAndDamp,     !- Soil Condition
  15.0,             !- Average Soil Surface Temperature
  5.6,              !- Amplitude of Soil Surface Temperature
  0.0,              !- Phase Constant of Soil Surface Temperature
  0.6060000    ,    !- Constant Term Flow Coef
  2.0199999E-02,    !- Temp Term Flow Coef
  5.9800001E-04,    !- Velocity Term Flow Coef
  0.0000000E+00;    !- Velocity**2 Term Flow Coef""")
roomattr = HBRoomAttributes({"Display Name": "display_name", "Simulation Name (Identifier)": "identifier", "Multiplier": "multiplier", "Story": "story", "Volume": "volume", "Gross Floor Area": "floor_area", "Exposed Area": "exposed_area", "Exterior Wall Area": "exterior_wall_area", "Exterior Aperture Area": "exterior_aperture_area", "Average Floor Elevation": "average_floor_height"}, selected="Simulation Name (Identifier)")
constantschedule = HBConstantSchedule(values=Slider(0.5, range=0..1), name="ETSch")  # -> report, schedule, idf_text; plug-in component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
labelrooms = HBLabelRooms(rooms_model=flatten(house_rooms), attribute=roomattr)  # -> label_text, base_pts, labels, wire_frame; plug-in component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
rep = ReplaceText(Text=panel, Find="***room***", Replace=labelrooms.label_text, RecursiveReplace=False)
merge = Merge(Data1=constantschedule.idf_text, Data2=rep)  # -> flatten(Result)

panel_2 = Panel(merge)

# ----
# Download EPW File
panel_3 = Panel("http://climate.onebuilding.org/WMO_Region_4_North_and_Central_America/USA_United_States_of_America/CA_California/USA_CA_Burbank-Hope.AP.722880_TMY3.zip")
downloadepw = LBDownloadWeather(weather_URL=panel_3)  # -> epw_file, stat_file, ddy_file; plug-in component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

# ----
# Create Model
panel_4 = Panel("single_family_home")
model = HBModel(rooms=flatten(house_rooms), name=panel_4)  # -> report, model; plug-in component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

toggle_2 = BooleanToggle(False)
modeltoosm = HBModelToOSM(model=model.model, epw_file=downloadepw.epw_file, add_str=merge, write=toggle_2, run=toggle_2)  # -> report, jsons, osw, osm, idf, sql, zsz, rdd, html; plug-in component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
panel_5 = Panel(modeltoosm.sql)
