# Grasshopper definition single_family_energy_model.gh (Grasshopper 1.0.7)

# ----
# Setup Model
toggle = BooleanToggle(True)
geo = Geometry([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])
intsolid = HBIntersectSolids(solids=flatten(geo), run=toggle)  # -> int_solids; plug-in component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
geo_2 = Geometry([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])
aperture = HBAperture(geo=geo_2, operable=Toggle(True))  # -> report, apertures; plug-in component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
roomsolid = HBRoomFromSolid(
    geo=flatten(intsolid),
    name="Residence",
    constr_set="2013::ClimateZone5::SteelFramed",
    program="2013::MidriseApartment::Apartment",
    conditioned=True)  # -> report, rooms; plug-in component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
bordershades = HBExtrudedBorderShades(hb_objs=flatten(aperture.apertures), depth="0.3")  # -> report, hb_objs; plug-in component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
applysetpointvals = HBApplySetpointValues(room_or_program=flatten(roomsolid.rooms), cooling_setpt="28", heating_setpt="21")  # -> report, mod_obj; plug-in component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
addsubface = HBAddSubface(hb_obj=flatten(applysetpointvals.mod_obj), sub_faces=flatten(bordershades.hb_objs))  # -> hb_obj; plug-in component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
ventcontrol = HBVentilationControl(min_in_temp="22", max_in_temp="27", min_out_temp="12", delta_temp="0")  # -> vent_cntrl; plug-in component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
windowopen = HBWindowOpening(rooms=flatten(addsubface), vent_cntrl=ventcontrol)  # -> report, rooms; plug-in component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
geo_3 = Geometry([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])
shade = HBShade(geo=geo_3)  # -> report, shades; plug-in component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
solveadj = HBSolveAdjacency(rooms=flatten(windowopen.rooms), run=toggle)  # -> report, adj_rooms; plug-in component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

# ----
# Request Outputs
toggle_2 = BooleanToggle(True)
simoutput = HBSimulationOutput(zone_energy_use=toggle_2, gains_and_losses=toggle_2, comfort_metrics=toggle_2, surface_energy_flow=toggle_2)  # -> report, sim_output; plug-in component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
simpar = HBSimulationParameter(output=simoutput.sim_output, timestep=6)  # -> sim_par; plug-in component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

# ----
# Download EPW File
panel = Panel("https://energyplus-weather.s3.amazonaws.com/north_and_central_america_wmo_region_4/USA/MA/USA_MA_Boston-Logan.Intl.AP.725090_TMY3/USA_MA_Boston-Logan.Intl.AP.725090_TMY3.zip")
downloadepw = LBDownloadWeather(weather_URL=panel)  # -> epw_file, stat_file, ddy_file; plug-in component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

house_shades = Data(flatten(shade.shades))
house_rooms = Data(flatten(solveadj.adj_rooms))

# ----
# Create Model
panel_2 = Panel("single_family_home")
model = HBModel(rooms=flatten(house_rooms), shades=flatten(house_shades), name=panel_2)  # -> report, model; plug-in component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

# ----
# Visualize Model
vizbytype = HBVisualizeByType(hb_objs=model.model)  # -> walls, interior_walls, roofs, ceilings, exterior_floors, interior_floors, air_walls, apertures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; plug-in component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

toggle_3 = BooleanToggle(False)
modeltoosm = HBModelToOSM(model=model.model, epw_file=downloadepw.epw_file, sim_par=simpar, write=toggle_3, run=toggle_3)  # -> report, jsons, osw, osm, idf, sql, zsz, rdd, html; plug-in component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

# ----
# See All
# Request-able
# Outputs
readrdd = HBReadResultDictionary(rdd=modeltoosm.rdd)  # -> outputs; plug-in component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
all_possible_outputs_to_request_from_the = Panel(readrdd)  # "All Possible Outputs to Request from the Simulation"

# ----
# Import
# Results
panel_3 = Panel("Zone Mean Air Temperature")
faceresult = HBReadFaceResult(sql=modeltoosm.sql)  # -> face_indoor_temp, face_outdoor_temp, face_energy_flow; plug-in component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
roomenergyresult = HBReadRoomEnergyResult(sql=modeltoosm.sql)  # -> cooling, heating, lighting, electric_equip, gas_equip, hot_water, fan_electric, pump_electric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; plug-in component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
customresult = HBReadCustomResult(sql=modeltoosm.sql, output_names=panel_3)  # -> results; plug-in component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
roomcomfortresult = HBReadRoomComfortResult(sql=modeltoosm.sql)  # -> oper_temp, air_temp, rad_temp, rel_humidity; plug-in component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

# ----
# Import Tabular Data
readtable = HBReadTabularData(sql=modeltoosm.sql, table_name="Utility Use Per Conditioned Floor Area")  # -> values, col_names, row_names; plug-in component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
branch = TreeBranch(Tree=simplify(readtable.values), Path="{3}", MaintainPaths=True)
ma = MassAddition(Input=branch)  # -> Result, PartialResults
eui_kwh_m2 = Panel(ma.Result)

# ----
# Import HVAC Sizing
readhvac = HBReadHVACSizing(sql=modeltoosm.sql)  # -> zone_names, zone_peak_cool, zone_peak_heat, comp_types, comp_properties, comp_values; plug-in component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
readzsz = HBReadZoneSizing(zsz=modeltoosm.zsz)  # -> cooling_load, heating_load; plug-in component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
zone_peak_heating_values_w = Panel(readhvac.zone_peak_heat)

data = Data(model.model)

# ----
# Plot Results
panel_4 = Panel("Thermal Load Balance")
arithop = LBArithmeticOperation(data_1=roomenergyresult.heating, data_2=roomenergyresult.cooling, operator="-", type=panel_4)  # -> data; plug-in component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
massarithop = LBMassArithmeticOperation(data=flatten(roomenergyresult.heating), operator="+", type="Total Heating Load")  # -> data; plug-in component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
hourlyplot = LBHourlyPlot(data=massarithop, base_pt="50, 0, 0")  # -> report, mesh, legend, borders, labels, title; plug-in component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

# ----
# Color Geometry
# with Results
colorrooms = HBColorRooms(data=flatten(roomenergyresult.cooling), rooms_model=flatten(data))  # -> report, mesh, wire_frame, legend, title, rooms, colors, values; plug-in component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
colorfaces = HBColorFaces(hb_objs=flatten(data))  # -> report, mesh, wire_frame, legend, title, faces, colors, values; plug-in component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

# ----
# Construct Energy Balance
# (storage term is hot water)
loadbalance = HBThermalLoadBalance(
    rooms_model=flatten(data),
    cooling=roomenergyresult.cooling,
    heating=roomenergyresult.heating,
    lighting=roomenergyresult.lighting,
    electric_equip=roomenergyresult.electric_equip,
    people_gain=roomenergyresult.people_gain,
    solar_gain=roomenergyresult.solar_gain,
    infiltration_load=roomenergyresult.infiltration_load,
    mech_vent_load=roomenergyresult.mech_vent_load,
    nat_vent_load=roomenergyresult.nat_vent_load,
    face_energy_flow=faceresult.face_energy_flow)  # -> report, balance, balance_storage, norm_bal, norm_bal_storage; plug-in component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
timeop = LBTimeIntervalOperation(data=loadbalance.norm_bal_storage)  # -> daily, monthly, mon_per_hr; plug-in component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
colrange = LBColorRange(index="19")  # -> colors; plug-in component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
neg = Negative(Value="60")
legendpar = LBLegendParameters(min=neg, max="60", colors=colrange, num_decimals="1", text_height="1.5")  # -> leg_par; plug-in component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
monthlychart = LBMonthlyChart(data=timeop.monthly, base_pt="-200, 0, 0", y_dim="60", stack=Toggle(True), legend_par=legendpar)  # -> report, data_mesh, data_lines, col_lines, legend, borders, labels, y_title, title; plug-in component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
