# Grasshopper definition vented_dsf_example.gh (Grasshopper 1.0.7)

# ----
# Dynamic Shade Window
number_slider = Slider(0.4, range=0..1)
number_slider_2 = Slider(0.5, range=0..1)
number_slider_3 = Slider(0.4, range=0..1)
number_slider_4 = Slider(45, range=0..90)
geo = Geometry(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)
blindmat = HBBlindMaterial(
    name="Wooden Shades",
    slat_width=number_slider_3,
    slat_separation=number_slider,
    slat_thickness="0.01",
    slat_angle=number_slider_4,
    dist_to_glass=number_slider_2)  # -> mat; plug-in component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
windowconstrshd = HBWindowConstructionShade(
    name="DSF Shaded Window Construction",
    win_constr="Generic Single Pane",
    shd_material=blindmat,
    shd_location="Interior",
    control_type="OnIfHighSolarOnWindow",
    setpoint="200")  # -> constr; plug-in component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
aperture = HBAperture(geo=geo, name="Retractable Shade Window", operable=Toggle(False), ep_constr=windowconstrshd)  # -> report, apertures; plug-in component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

# ----
# DSF Intake
geo_2 = Geometry(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)
aperture_2 = HBAperture(geo=geo_2, name="DSF Intake", operable=Toggle(True), ep_constr="Generic Single Pane")  # -> report, apertures; plug-in component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

# ----
# DSF Exhaust
geo_3 = Geometry(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)
aperture_3 = HBAperture(geo=geo_3, name="DSF Intake", operable=Toggle(True), ep_constr="Generic Single Pane")  # -> report, apertures; plug-in component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

# ----
# Lobby/DSF Window
geo_4 = Geometry(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)
aperture_4 = HBAperture(geo=geo_4, name="Lobby DSF Window", operable=Toggle(False), ep_constr="Generic Double Pane")  # -> report, apertures; plug-in component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

# ----
# Double Skin Facade Room
panel = Panel("Plenum")
geo_5 = Geometry(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)
roomsolid = HBRoomFromSolid(geo=flatten(geo_5), name="DSF", program=panel, conditioned=True)  # -> report, rooms; plug-in component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

# ----
# Conditioned Lobby
panel_2 = Panel("2019::MediumOffice::Lobby")
# Set Up Geometry
geo_6 = Geometry(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)
roomsolid_2 = HBRoomFromSolid(geo=flatten(geo_6), name="Lobby", program=panel_2, conditioned=True)  # -> report, rooms; plug-in component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
applysetpointvals = HBApplySetpointValues(room_or_program=flatten(roomsolid_2.rooms), cooling_setpt="24", heating_setpt="21")  # -> report, mod_obj; plug-in component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

# ----
# Set up DSF Ventilation Controls
panel_3 = Panel("18")
addsubface = HBAddSubface(hb_obj=flatten(roomsolid.rooms), sub_faces=flatten([aperture_2.apertures, aperture_3.apertures, aperture.apertures]))  # -> report, hb_obj, unmatched; plug-in component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
ventcontrol = HBVentilationControl(min_in_temp=panel_3, min_out_temp="12")  # -> vent_cntrl; plug-in component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
windowopen = HBWindowOpening(rooms=flatten(addsubface.hb_obj), vent_cntrl=ventcontrol, fract_area_oper="0.5")  # -> report, rooms; plug-in component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

# ----
# Resolve the Window Between Rooms
toggle = BooleanToggle(True)
solveadj = HBSolveAdjacency(rooms=flatten([applysetpointvals.mod_obj, windowopen.rooms]), run=toggle)  # -> report, adj_rooms; plug-in component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
addsubface_2 = HBAddSubface(hb_obj=flatten(solveadj.adj_rooms), sub_faces=flatten(aperture_4.apertures))  # -> report, hb_obj, unmatched; plug-in component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

# ----
# Simulation Parameters
panel_4 = Panel("https://energyplus-weather.s3.amazonaws.com/north_and_central_america_wmo_region_4/USA/IL/USA_IL_Chicago-OHare.Intl.AP.725300_TMY3/USA_IL_Chicago-OHare.Intl.AP.725300_TMY3.zip")
simoutput = HBSimulationOutput(comfort_metrics=Toggle(True))  # -> report, sim_output; plug-in component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
simpar = HBSimulationParameter(output=simoutput.sim_output, timestep=6)  # -> sim_par; plug-in component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
downloadepw = LBDownloadWeather(weather_URL=panel_4)  # -> epw_file, stat_file, ddy_file; plug-in component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

# ----
# Use the AFN to Model
# Bouyancy Pressure Difference
panel_5 = Panel("Sample DSF")
model = HBModel(rooms=flatten(addsubface_2.hb_obj), name=panel_5)  # -> report, model; plug-in component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
afn = HBAirflowNewtwork(model=model.model)  # -> report, model; plug-in component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

# ----
# Preview Retractable Shades
panel_6 = Panel("90")
addition = Addition(A=number_slider_4, B=panel_6)
louvershades = HBLouverShades(
    hb_objs=flatten(aperture.apertures),
    depth=number_slider_3,
    dist_between=number_slider,
    facade_offset=number_slider_2,
    angle=addition,
    indoor=Toggle(True))  # -> report, hb_objs; plug-in component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
vizbytype = HBVisualizeByType(hb_objs=louvershades.hb_objs)  # -> walls, interior_walls, roofs, ceilings, exterior_floors, interior_floors, air_walls, apertures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; plug-in component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
# Preview Geometry
geo_7 = Geometry([vizbytype.indoor_shades, vizbytype.wire_frame])

toggle_2 = BooleanToggle(False)

# ----
# Preview Windows and Rooms
data = Data(afn.model)
facesbytype = HBFacesByType(hb_objs=data)  # -> walls, interior_walls, roofs, ceilings, exterior_floors, interior_floors, air_walls, apertures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; plug-in component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
vizwiref = HBVisualizeWireframe(hb_objs=flatten(data))  # -> geo; plug-in component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
vizquick = HBVisualizeQuick(hb_objs=flatten([facesbytype.apertures, facesbytype.interior_apertures]))  # -> geo; plug-in component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
preview = CustomPreview(Geometry=vizquick, Material=ColourSwatch(SwatchColor=RGBA(128, 176, 255, 105)))

# ----
# Run Simulation
modeltoosm = HBModelToOSM(model=afn.model, epw_file=downloadepw.epw_file, sim_par=simpar, write=toggle_2, run=toggle_2)  # -> report, jsons, osw, osm, idf, sql, zsz, rdd, html; plug-in component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

# ----
# Preview Zone Temperatures
roomcomfortresult = HBReadRoomComfortResult(sql=modeltoosm.sql)  # -> oper_temp, air_temp, rad_temp, rel_humidity, unmet_heat, unmet_cool; plug-in component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
hourlyplot = LBHourlyPlot(data=roomcomfortresult.air_temp, base_pt="100, 0, 0")  # -> report, mesh, legend, borders, labels, title, vis_set; plug-in component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
