# Grasshopper definition window_constructions_with_dynamic_shades.gh (Grasshopper 1.0.7)

brep = Brep(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)
brep_2 = Brep(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)
brep_3 = Brep(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)
brep_4 = Brep([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])
brep_5 = Brep(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)
face = HBFace(geo=brep_4, name="Vertical Window")  # -> report, faces; plug-in component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
face_2 = HBFace(geo=brep_3)  # -> report, faces; plug-in component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
face_3 = HBFace(geo=brep, name="Horizontal Skylight")  # -> report, faces; plug-in component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
face_4 = HBFace(geo=brep_2)  # -> report, faces; plug-in component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
face_5 = HBFace(geo=brep_5)  # -> report, faces; plug-in component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
skylightsbyratio = HBSkylightsByRatio(hb_objs=flatten(face_3.faces), ratio="0.9")  # -> report, hb_objs; plug-in component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
aperturesbyratio = HBAperturesByRatio(hb_objs=flatten(face.faces), ratio="0.4", win_height="3", sill_height="0.3")  # -> report, hb_objs; plug-in component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

brep_6 = Brep(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)
brep_7 = Brep([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])
face_6 = HBFace(geo=brep_7)  # -> report, faces; plug-in component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
face_7 = HBFace(geo=brep_6, name="Vertical Skylight")  # -> report, faces; plug-in component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
aperturesbyratio_2 = HBAperturesByRatio(hb_objs=flatten(face_7.faces), ratio="0.8", horiz_separ="2")  # -> report, hb_objs; plug-in component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

# ----
# ELECTROCHROMIC
# GLAZING
panel = Panel("EC Glass On")
glassmat = HBGlassMaterial(name=panel, thickness="0.005", transmittance="0.01", emiss_back="0.1")  # -> mat; plug-in component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
windowconstrshd = HBWindowConstructionShade(
    name="Generic Electrochromic Window",
    win_constr="Generic Double Pane",
    shd_material=glassmat,
    shd_location="Exterior",
    control_type="OnIfHighSolarOnWindow",
    setpoint="300")  # -> constr; plug-in component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
applywindowconstr = HBApplyWindowConstruction(hb_objs=flatten(aperturesbyratio.hb_objs), constr=windowconstrshd)  # -> hb_objs; plug-in component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

# ----
# BLINDS
panel_2 = Panel("Vertical Blind")
blindmat = HBBlindMaterial(
    name=panel_2,
    slat_width="0.025",
    slat_separation="0.025",
    slat_thickness="0.002",
    conductivity="0.0575",
    transmittance="0.516",
    reflectance="0.463",
    dist_to_glass="0.05")  # -> mat; plug-in component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
windowconstrshd_2 = HBWindowConstructionShade(
    name="Generic Window with Blinds",
    win_constr="Generic Double Pane",
    shd_material=blindmat,
    shd_location="Exterior",
    control_type="OnIfHighSolarOnWindow",
    setpoint="300")  # -> constr; plug-in component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
applywindowconstr_2 = HBApplyWindowConstruction(hb_objs=flatten(aperturesbyratio_2.hb_objs), constr=windowconstrshd_2)  # -> hb_objs; plug-in component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

# ----
# SHADES
panel_3 = Panel("Perforated Screen")
shademat = HBShadeMaterial(name=panel_3, thickness="0.002", transmittance="0.1", dist_to_glass="0.1", permeability="0.1")  # -> mat; plug-in component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
windowconstrshd_3 = HBWindowConstructionShade(
    name="Generic Window with Shades",
    win_constr="Generic Double Pane",
    shd_material=shademat,
    shd_location="Exterior",
    control_type="OnIfHighSolarOnWindow",
    setpoint="300")  # -> constr; plug-in component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
applywindowconstr_3 = HBApplyWindowConstruction(hb_objs=flatten(skylightsbyratio.hb_objs), constr=windowconstrshd_3)  # -> hb_objs; plug-in component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

room = HBRoom(
    faces=flatten([applywindowconstr_3, face_4.faces, face_5.faces, face_2.faces, applywindowconstr]),
    name="Zone1",
    program="2019::MidriseApartment::Corridor",
    conditioned=True)  # -> report, room; plug-in component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
room_2 = HBRoom(
    faces=flatten([applywindowconstr_2, face_6.faces]),
    name="Zone2",
    program="2019::MidriseApartment::Corridor",
    conditioned=True)  # -> report, room; plug-in component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
toggle = BooleanToggle(True)
solveadj = HBSolveAdjacency(rooms=flatten([room_2.room, room.room]), air_boundary=toggle, run=toggle)  # -> report, adj_rooms; plug-in component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
model = HBModel(rooms=flatten(solveadj.adj_rooms))  # -> report, model; plug-in component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

panel_4 = Panel("https://energyplus-weather.s3.amazonaws.com/north_and_central_america_wmo_region_4/USA/MA/USA_MA_Boston-Logan.Intl.AP.725090_TMY3/USA_MA_Boston-Logan.Intl.AP.725090_TMY3.zip")
downloadepw = LBDownloadWeather(weather_URL=panel_4)  # -> epw_file, stat_file, ddy_file; plug-in component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

panel_5 = Panel("Surface Window Transmitted Solar Radiation Rate")
customoutput = HBCustomSimulationOutput(output_names=panel_5)  # -> report, sim_output; plug-in component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
simpar = HBSimulationParameter(output=customoutput.sim_output, timestep=6)  # -> sim_par; plug-in component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

vizbytype = HBVisualizeByType(hb_objs=model.model)  # -> walls, interior_walls, roofs, ceilings, exterior_floors, interior_floors, air_walls, apertures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; plug-in component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
toggle_2 = BooleanToggle(False)
modeltoosm = HBModelToOSM(model=model.model, epw_file=downloadepw.epw_file, sim_par=simpar, write=toggle_2, run=toggle_2)  # -> report, jsons, osw, osm, idf, sql, zsz, rdd, html; plug-in component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

customresult = HBReadCustomResult(sql=modeltoosm.sql, output_names=panel_5)  # -> results; plug-in component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
hourlyplot = LBHourlyPlot(data=customresult, base_pt="30, 0, 0")  # -> report, mesh, legend, borders, labels, title, vis_set; plug-in component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
