# Grasshopper definition auto_dynamic_apertures.gh (Grasshopper 1.0.7)

# ---- group: Opaque Faces
geo = Geometry([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])
roomsolid = HBRoomFromSolid(geo=flatten(geo), name="TestRoom", conditioned=True)  # -> report, rooms; plug-in component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

# ---- group: Apertures
# Geometry Preparation
panel = Panel("g_material")
glassmod = HBGlassModifier(name=panel, trans="0.55")  # -> modifier; plug-in component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
brep = Brep([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])
aperture = HBAperture(geo=brep, rad_mod=glassmod)  # -> report, apertures; plug-in component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
addsubface = HBAddSubface(hb_obj=flatten(roomsolid.rooms), sub_faces=flatten(aperture.apertures))  # -> report, hb_obj, unmatched; plug-in component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
bordershades = HBExtrudedBorderShades(hb_objs=flatten(addsubface.hb_obj), depth="0.3")  # -> report, hb_objs; plug-in component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

# ---- group: Context!
brep_2 = Brep([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])
shade = HBShade(geo=brep_2)  # -> report, shades; plug-in component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

# ----
# Wea
panel_2 = Panel("https://energyplus-weather.s3.amazonaws.com/north_and_central_america_wmo_region_4/USA/MA/USA_MA_Boston-Logan.Intl.AP.725090_TMY3/USA_MA_Boston-Logan.Intl.AP.725090_TMY3.zip")
downloadepw = LBDownloadWeather(weather_URL=panel_2)  # -> epw_file, stat_file, ddy_file; plug-in component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
wea = HBWeaFromEPW(epw_file=downloadepw.epw_file)  # -> wea; plug-in component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

# ----
# Dynamic Group States
panel_3 = Panel("0.66")
glassmod_2 = HBGlassModifier(trans=panel_3)  # -> modifier; plug-in component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
glassmod_3 = HBGlassModifier(trans="0.46")  # -> modifier; plug-in component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
state = HBDynamicState(modifier=glassmod_2)  # -> state; plug-in component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
state_2 = HBDynamicState(modifier=glassmod_3)  # -> state; plug-in component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
merge = Merge(Data1=state, Data2=state_2)

# ----
# Model + Grids
panel_4 = Panel("sample_model_grid")
model = HBModel(rooms=flatten(bordershades.hb_objs), shades=flatten(shade.shades), name=panel_4)  # -> report, model; plug-in component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
gridrooms = HBSensorGridFromRooms(rooms=bordershades.hb_objs, grid_size="0.5")  # -> grid, points, mesh; plug-in component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
assigngridsviews = HBAssignGridsAndViews(model=model.model, grids=flatten(gridrooms.grid))  # -> model; plug-in component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
vizwiref = HBVisualizeWireframe(hb_objs=flatten(model.model))  # -> geo; plug-in component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

# ----
# Auto-Assign
# Dynamic Groups
toggle = BooleanToggle(True)
autogroup = HBAutomaticApertureGroup(model=assigngridsviews, room_based=Toggle(False), states=merge, run=toggle)  # -> model; plug-in component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

# ----
# Visualize Assiged Groups
faceradianceattr = HBFaceRadianceAttributes({"Modifier": "properties.radiance.modifier.display_name", "Average Reflectance": "properties.radiance.modifier.average_reflectance", "Average Transmittance": "properties.radiance.modifier.average_transmittance", "Modifier Blk": "properties.radiance.modifier_blk.display_name", "Is Opaque": "properties.radiance.is_opaque", "Dynamic Group": "properties.radiance.dynamic_group_identifier", "State Count": "properties.radiance.state_count", "States": "properties.radiance.states"}, selected="Dynamic Group")
colorfaceattr = HBColorFaceAttributes(hb_objs=flatten(autogroup), attribute=faceradianceattr)  # -> mesh, legend, wire_frame, values, colors, vis_set; plug-in component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

getdyn = HBGetDynamicGroups(model=autogroup)  # -> group_ids, group_aps; plug-in component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
panel_5 = Panel(getdyn.group_ids)
bang = ExplodeTree(Data=getdyn.group_aps)  # -> Branch0, Branch1, Branch2
groupsch = HBApertureGroupSchedule(group_aps=bang.Branch1, schedule="0")  # -> dyn_sch; plug-in component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
groupsch_2 = HBApertureGroupSchedule(group_aps=bang.Branch2, schedule="-1")  # -> dyn_sch; plug-in component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
groupsch_3 = HBApertureGroupSchedule(group_aps=bang.Branch0, schedule="0")  # -> dyn_sch; plug-in component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

# ----
# Run Recipe
annualdaylight = HBAnnualDaylight(model=autogroup, wea=wea, enhanced=Toggle(True), run=Toggle(False))  # -> report, results, DA, cDA, UDI, UDI_low, UDI_up; plug-in component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

all_schedules = Data(flatten([groupsch_3, groupsch, groupsch_2]))
daylightmetrics = HBAnnualDaylightMetrics(results=flatten(annualdaylight.results), dyn_sch=flatten(all_schedules))  # -> report, DA, cDA, UDI, UDI_low, UDI_up; plug-in component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

# ----
# Compute sDA
sda = HBSpatialDaylightAutonomy(DA=daylightmetrics.DA)  # -> report, sDA, pass_fail; plug-in component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
sda_in_each_room = Panel(sda.sDA)

# ----
# Visualize Daylight Autonomy
mjoin = MeshJoin(Meshes=gridrooms.mesh)
data = Data(flatten(daylightmetrics.DA))
heatmap = LBSpatialHeatmap(values=data, mesh=mjoin, legend_title="%")  # -> mesh, legend, title, colors, legend_par, vis_set; plug-in component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
