# Grasshopper definition creating_modifiers.gh (Grasshopper 1.0.7)

# ----
# Create New ModifierSet
exteriorsubset = HBExteriorModifierSubset()  # -> exterior_set; plug-in component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
interiorsubset = HBInteriorModifierSubset()  # -> interior_set; plug-in component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
subfacesubset = HBSubfaceModifierSubset()  # -> subface_set; plug-in component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
shadesubset = HBShadeModifierSubset()  # -> shade_set; plug-in component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
modifierset = HBModifierSet(exterior_subset=exteriorsubset, interior_subset=interiorsubset, subface_subset=subfacesubset, shade_subset=shadesubset)  # -> mod_set; plug-in component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

# ----
# Search Modifier + ModifierSet Libraries
searchmods = HBSearchModifiers()  # -> modifiers; plug-in component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
searchmodsets = HBSearchModifierSets()  # -> mod_sets; plug-in component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
panel = Panel(searchmodsets)
panel_2 = Panel(searchmods)

# ----
# Deconstruct Modifier + ModifierSet
item = ListItem(List=panel, Index=0, Wrap=True)
item_2 = ListItem(List=panel_2, Index=0, Wrap=True)
construction_set = Data(item)
decnstrconstrsetint = HBDeconstructModifierSetInterior(mod_set=construction_set)  # -> interior_wall, ceiling, interior_floor, interior_window, interior_door, int_glass_door, interior_shade; plug-in component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
decnstrmodset = HBDeconstructModifierSet(mod_set=construction_set)  # -> exterior_wall, exterior_roof, exposed_floor, window, skylight, operable, exterior_door, overhead_door, glass_door, exterior_shade; plug-in component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
decnstrmod = HBDeconstructModifier(mod=item_2)  # -> rad_str; plug-in component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
panel_3 = Panel(decnstrmodset.exterior_roof)
panel_4 = Panel(decnstrconstrsetint.ceiling)
panel_5 = Panel(decnstrmod)

# ----
# Apply Modifiers
# to Objects
applywindowmod = HBApplyWindowModifier()  # -> hb_objs; plug-in component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
applyshademod = HBApplyShadeModifier()  # -> hb_objs; plug-in component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
applyfacemod = HBApplyFaceModifier()  # -> hb_objs; plug-in component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
applymodset = HBApplyModifierSet()  # -> rooms; plug-in component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

# ----
# Create Modifiers
swatch = ColourSwatch(SwatchColor=RGB(201, 199, 83))
argb = SplitARGB(Colour=swatch)  # -> Alpha, Red, Green, Blue
argb_2 = SplitARGB(Colour=ColourSwatch(SwatchColor=RGB(255, 166, 166)))  # -> Alpha, Red, Green, Blue
path = FilePath("C:\Users\chris\Documents\GitHub\honeybee-radiance\tests\assets\diffuse50.xml")
argb_3 = SplitARGB(Colour=ColourSwatch(SwatchColor=RGB(53, 156, 204)))  # -> Alpha, Red, Green, Blue
argb_4 = SplitARGB(Colour=ColourSwatch(SwatchColor=RGB(39, 214, 41)))  # -> Alpha, Red, Green, Blue
argb_5 = SplitARGB(Colour=ColourSwatch(SwatchColor=RGB(156, 225, 255)))  # -> Alpha, Red, Green, Blue
bsdfmod = HBBSDFModifier(xml_file=path)  # -> modifier; plug-in component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
transmod = HBTranslucentModifier(name="Kalwall", diff_ref="0.5", diff_trans="0.35")  # -> modifier; plug-in component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
glassmod3 = HBGlassModifier3(name="BlueGlass", r_trans=argb_3.Red, g_trans=argb_3.Green, b_trans=argb_3.Blue)  # -> modifier; plug-in component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
glassmod = HBGlassModifier(name="Safety Glass", trans="0.35")  # -> modifier; plug-in component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
mirrormod = HBMirrorModifier(name="TypicalMirror085", reflect="0.85")  # -> modifier; plug-in component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
metalmod = HBMetalModifier(name="Polished_Aluminum")  # -> modifier; plug-in component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
mirrormod3 = HBMirrorModifier3(name="Blue Mirror", r_ref=argb_5.Red, g_ref=argb_5.Green, b_ref=argb_5.Blue)  # -> modifier; plug-in component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
panel_6 = Panel(glassmod)
panel_7 = Panel(metalmod)
panel_8 = Panel(glassmod3)
panel_9 = Panel(bsdfmod)
panel_10 = Panel(transmod)
panel_11 = Panel(mirrormod)
panel_12 = Panel(mirrormod3)

division = Division(A=argb.Red, B="2")
division_2 = Division(A=argb.Green, B="2")
division_3 = Division(A=argb.Blue, B="2")
division_4 = Division(A=argb_2.Red, B="10")
division_5 = Division(A=argb_2.Green, B="10")
division_6 = Division(A=argb_2.Blue, B="10")
opaquemod3 = HBOpaqueModifier3(name="Foliage", r_ref=argb_4.Red, g_ref=argb_4.Green, b_ref=argb_4.Blue)  # -> modifier; plug-in component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
opaquemod = HBOpaqueModifier(name="Concrete_035", reflect="0.35")  # -> modifier; plug-in component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

transmod3 = HBTranslucentModifier3(
    name="Yellow_Panelite",
    r_diff_ref=division,
    g_diff_ref=division_2,
    b_diff_ref=division_3,
    diff_trans="0.35",
    spec_trans="0.05",
    rough=0)  # -> modifier; plug-in component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
metalmod3 = HBMetalModifier3(name="Rose_Gold", r_diff=division_4, g_diff=division_5, b_diff=division_6, spec="0.8")  # -> modifier; plug-in component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
panel_13 = Panel(opaquemod)
panel_14 = Panel(opaquemod3)
panel_15 = Panel(metalmod3)
panel_16 = Panel(transmod3)
