# Grasshopper definition dynamic_apertures.gh (Grasshopper 1.0.7)

# ----
# All Apertures
panel = Panel("g_material")
brep = Brep([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])
glassmod = HBGlassModifier(name=panel, trans="0.55")  # -> modifier; plug-in component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
aperture = HBAperture(geo=brep, rad_mod=glassmod)  # -> report, apertures; plug-in component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

# ----
# Dynamic States
panel_2 = Panel("0.66")
glassmod_2 = HBGlassModifier(trans=panel_2)  # -> modifier; plug-in component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
glassmod_3 = HBGlassModifier(trans="0.46")  # -> modifier; plug-in component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
state = HBDynamicState(modifier=glassmod_2)  # -> state; plug-in component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
state_2 = HBDynamicState(modifier=glassmod_3)  # -> state; plug-in component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
merge = Merge(Data1=state, Data2=state_2)

item = ListItem(List=aperture.apertures, Index=0, Wrap=True)  # -> Item, Item1, Item2, Item3, Item4, Item5, Item6

dynamic_group_1 = Data([item.Item4, item.Item5])
aperturegroup = HBDynamicApertureGroup(apertures=dynamic_group_1, name="Group_1", states=merge)  # -> group_aps; plug-in component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

dynamic_group_2 = Data(item.Item6)
aperturegroup_2 = HBDynamicApertureGroup(apertures=dynamic_group_2, name="Group_2", states=merge)  # -> group_aps; plug-in component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

static_apertures = Data([item.Item, item.Item1, item.Item2, item.Item3])
all_apertures = Data(flatten([static_apertures, aperturegroup, aperturegroup_2]))

# ----
# Room Preparation
panel_3 = Panel("TestRoom")
geo = Geometry([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])
roomsolid = HBRoomFromSolid(geo=flatten(geo), name=panel_3, conditioned=True)  # -> report, rooms; plug-in component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
addsubface = HBAddSubface(hb_obj=flatten(roomsolid.rooms), sub_faces=flatten(all_apertures))  # -> report, hb_obj, unmatched; plug-in component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
bordershades = HBExtrudedBorderShades(hb_objs=flatten(addsubface.hb_obj), depth="0.3")  # -> report, hb_objs; plug-in component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

brep_2 = Brep([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])
shade = HBShade(geo=brep_2)  # -> report, shades; plug-in component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

# ----
# Wea
panel_4 = Panel("https://energyplus-weather.s3.amazonaws.com/north_and_central_america_wmo_region_4/USA/MA/USA_MA_Boston-Logan.Intl.AP.725090_TMY3/USA_MA_Boston-Logan.Intl.AP.725090_TMY3.zip")
downloadepw = LBDownloadWeather(weather_URL=panel_4)  # -> epw_file, stat_file, ddy_file; plug-in component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
wea = HBWeaFromEPW(epw_file=downloadepw.epw_file)  # -> wea; plug-in component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

# ----
# Model + Grids
panel_5 = Panel("sample_model_grid")
model = HBModel(rooms=flatten(bordershades.hb_objs), shades=flatten(shade.shades), name=panel_5)  # -> report, model; plug-in component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
gridrooms = HBSensorGridFromRooms(rooms=bordershades.hb_objs, grid_size="0.5")  # -> grid, points, mesh; plug-in component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
assigngridsviews = HBAssignGridsAndViews(model=model.model, grids=flatten(gridrooms.grid))  # -> model; plug-in component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
vizwiref = HBVisualizeWireframe(hb_objs=flatten(model.model))  # -> geo; plug-in component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

# ----
# Visualize Assiged Groups
faceradianceattr = HBFaceRadianceAttributes({"Modifier": "properties.radiance.modifier.display_name", "Average Reflectance": "properties.radiance.modifier.average_reflectance", "Average Transmittance": "properties.radiance.modifier.average_transmittance", "Modifier Blk": "properties.radiance.modifier_blk.display_name", "Is Opaque": "properties.radiance.is_opaque", "Dynamic Group": "properties.radiance.dynamic_group_identifier", "State Count": "properties.radiance.state_count", "States": "properties.radiance.states"}, selected="Dynamic Group")
colorfaceattr = HBColorFaceAttributes(hb_objs=flatten(assigngridsviews), attribute=faceradianceattr)  # -> mesh, legend, wire_frame, values, colors, vis_set; plug-in component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

# ----
# Dynamic schedule of states
panel_6 = Panel("-1")
groupsch = HBApertureGroupSchedule(group_aps=aperturegroup_2, schedule="1")  # -> dyn_sch; plug-in component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
groupsch_2 = HBApertureGroupSchedule(group_aps=aperturegroup, schedule=panel_6)  # -> dyn_sch; plug-in component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
all_schedules = Data([groupsch_2, groupsch])

# ----
# Run Recipe
annualdaylight = HBAnnualDaylight(model=assigngridsviews, wea=wea, enhanced=Toggle(True), run=Toggle(False))  # -> report, results, DA, cDA, UDI, UDI_low, UDI_up; plug-in component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

daylightmetrics = HBAnnualDaylightMetrics(results=flatten(annualdaylight.results), dyn_sch=flatten(all_schedules))  # -> report, DA, cDA, UDI, UDI_low, UDI_up; plug-in component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

# ----
# Compute sDA
sda = HBSpatialDaylightAutonomy(DA=daylightmetrics.DA)  # -> report, sDA, pass_fail; plug-in component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
sda_in_each_room = Panel(sda.sDA)

# ----
# Visualize Daylight Autonomy
mjoin = MeshJoin(Meshes=gridrooms.mesh)
data = Data(flatten(daylightmetrics.DA))
heatmap = LBSpatialHeatmap(values=data, mesh=mjoin, legend_title="%")  # -> mesh, legend, title, colors, legend_par, vis_set; plug-in component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
