# Grasshopper definition electric_lighting_view.gh (Grasshopper 1.0.7)
# plug-ins: LadybugGrasshopper

# ----
# View
# Use these component to create views.
# You can create a view from either a Rhino
# viewport or from raw parameters descriving
# the view.
crv = Curve(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)
end = EndPoints(Curve=crv)  # -> Start, End
vec2pt = Vector2Pt(PointA=end.Start, PointB=end.End, Unitize=False)  # -> Vector, Length
vdisex = VectorDisplayEx(Point=end.Start, Vector=vec2pt.Vector, Colour=RGB(0, 0, 0), Width=2)
view = HBView(name="indoor view", position=end.Start, direction=vec2pt.Vector, view_type="1")  # -> view; plug-in component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
viewport = HBViewFromViewport(name="outdoor view", refresh=Button())  # -> view; plug-in component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

# ---- group: Context!
brep = Brep([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])
shade = HBShade(geo=brep)  # -> report, shades; plug-in component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

# ---- group: Opaque Faces
geo = Geometry([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])
roomsolid = HBRoomFromSolid(geo=flatten(geo), conditioned=True)  # -> report, rooms; plug-in component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

# ---- group: Apertures
# Geometry Preparation
panel = Panel("g_material")
glassmod = HBGlassModifier(name=panel, trans="0.55")  # -> modifier; plug-in component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
brep_2 = Brep([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])
aperture = HBAperture(geo=brep_2, rad_mod=glassmod)  # -> report, apertures; plug-in component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
addsubface = HBAddSubface(hb_obj=flatten(roomsolid.rooms), sub_faces=flatten(aperture.apertures))  # -> report, hb_obj, unmatched; plug-in component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
bordershades = HBExtrudedBorderShades(hb_objs=flatten(addsubface.hb_obj), depth="0.3")  # -> report, hb_objs; plug-in component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

# ----
# Model
panel_2 = Panel("hb_sample_model_view")
model = HBModel(rooms=flatten(bordershades.hb_objs), shades=flatten(shade.shades), name=panel_2)  # -> report, model; plug-in component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
assigngridsviews = HBAssignGridsAndViews(model=model.model, views=flatten(view))  # -> model; plug-in component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
vizwiref = HBVisualizeWireframe(hb_objs=flatten(model.model))  # -> geo; plug-in component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

panel_3 = Panel("""0
0
-90""")
panel_4 = Panel("""0
0
-90""")

# ----
# Luminaires
# Use these component to create luminaires.
# The IES input can be an IES file path or a
# string representation of the IES file content.
panel_5 = Panel("""IESNA:LM-63-2002
[TEST] Sample
[LUMINAIRE] SampleLuminaire
[LAMPCAT] LED 10W
[LAMP] 1000 lm,10 W
TILT=NONE
1 1000 1.0 73 1 1 2 -1.000 0.000 0.000
1.0 1.0 10
   0.0   2.5   5.0   7.5  10.0  12.5  15.0  17.5  20.0  22.5  25.0  27.5  30.0
  32.5  35.0  37.5  40.0  42.5  45.0  47.5  50.0  52.5  55.0  57.5  60.0  62.5
  65.0  67.5  70.0  72.5  75.0  77.5  80.0  82.5  85.0  87.5  90.0  92.5  95.0
  97.5 100.0 102.5 105.0 107.5 110.0 112.5 115.0 117.5 120.0 122.5 125.0 127.5
 130.0 132.5 135.0 137.5 140.0 142.5 145.0 147.5 150.0 152.5 155.0 157.5 160.0
 162.5 165.0 167.5 170.0 172.5 175.0 177.5 180.0
   0.0
    10000.0    9981.4    9937.1    9847.4    9761.3    9640.4    9507.1    9350.1
     9171.9    8977.7    8763.1    8537.2    8288.5    8021.1    7741.1    7447.4
     7131.0    6806.5    6463.2    6106.3    5736.0    5356.5    4964.7    4562.0
     4149.2    3729.3    3304.3    2878.2    2454.2    2032.0    1614.5    1208.8
      823.2     483.4     232.4      84.4      23.2      10.5       8.8       7.6
        7.0       6.5       6.0       5.4       4.9       4.4       3.5       3.0
        2.5       1.9       1.4       1.1       1.1       1.1       2.8       3.5
        1.4       0.5       0.4       0.4       0.4       0.4       0.4       0.4
        0.4       0.4       0.0       0.0       0.0       0.0       0.0       0.0
       0.0""")
pt = ConstructPoint(XCoordinate="9", YCoordinate="5", ZCoordinate="5")
pt_2 = ConstructPoint(XCoordinate="6", YCoordinate="9", ZCoordinate="3")
pt_3 = ConstructPoint(XCoordinate="4", YCoordinate="5", ZCoordinate="5")
luminairezone = HBLuminaireZone(points=[pt_3, pt, pt_2], tilt=panel_3, rotation=panel_4)  # -> report, luminaire_zone; plug-in component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
luminaire = HBLuminaire(ies=panel_5, luminaire_zone=luminairezone.luminaire_zone)  # -> report, luminaire; plug-in component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
assignluminaires = HBAssignLuminaires(model=assigngridsviews, luminaires=flatten(luminaire.luminaire))  # -> model; plug-in component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
vizluminaire = HBVisualizeLuminaire(luminaire=luminaire.luminaire)  # -> report, lum_poly, lum_web, lum_axes; plug-in component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

# ----
# Sky
panel_6 = Panel("0")
certainillum = HBCertainIlluminance(value=panel_6)  # -> sky; plug-in component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

pitview = HBPointInTimeViewBased(model=assignluminaires, sky=certainillum, run=Toggle(False))  # -> report, results; plug-in component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

falsecolor = HBFalseColor(hdr=pitview.results, max="300", legend_height="650", legend_width="140", mask=Toggle(True))  # -> hdr; plug-in component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

adjusthdr = HBAdjustHDR(hdr=pitview.results, adj_expos=Toggle(True))  # -> hdr; plug-in component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
imageviewer = LBImageViewer(ImagePath_=falsecolor, _scale_=1, DisableClickable=False, SaveImgWithCoords=False, scale=1)  # -> ImagePath, Values, GIF
imageviewer_2 = LBImageViewer(ImagePath_=adjusthdr, _scale_=1, DisableClickable=False, SaveImgWithCoords=False, scale=1)  # -> ImagePath, Values, GIF
