# Grasshopper definition leed_i.gh (Grasshopper 1.0.7)

# ---- group: Opaque Faces
geo = Geometry([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])
roomsolid = HBRoomFromSolid(geo=flatten(geo), name="TestRoom", conditioned=True)  # -> report, rooms; plug-in component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

# ---- group: Apertures
# Geometry Preparation
panel = Panel("g_material")
glassmod = HBGlassModifier(name=panel, trans="0.55")  # -> modifier; plug-in component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
brep = Brep([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])
aperture = HBAperture(geo=brep, rad_mod=glassmod)  # -> report, apertures; plug-in component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
addsubface = HBAddSubface(hb_obj=flatten(roomsolid.rooms), sub_faces=flatten(aperture.apertures))  # -> report, hb_obj, unmatched; plug-in component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
bordershades = HBExtrudedBorderShades(hb_objs=flatten(addsubface.hb_obj), depth="0.3")  # -> report, hb_objs; plug-in component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

# ---- group: Context!
brep_2 = Brep([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])
shade = HBShade(geo=brep_2)  # -> report, shades; plug-in component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

# ----
# Aperture Groups: Manual grouping
# If you are creating the aperture groups manually, make sure
# that you do NOT also use the automatic grouping component.
# You must select one method only.
item = ListItem(List=brep, Index=0, Wrap=True)  # -> Item, Item1, Item2, Item3, Item4, Item5, Item6
brep_3 = Brep(item.Item)
brep_4 = Brep(item.Item1)
brep_5 = Brep([item.Item4, item.Item5])
brep_6 = Brep([item.Item2, item.Item3])
brep_7 = Brep(item.Item6)
aperture_2 = HBAperture(geo=brep_3)  # -> report, apertures; plug-in component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
aperture_3 = HBAperture(geo=brep_4)  # -> report, apertures; plug-in component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
aperture_4 = HBAperture(geo=brep_5)  # -> report, apertures; plug-in component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
aperture_5 = HBAperture(geo=brep_6)  # -> report, apertures; plug-in component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
aperture_6 = HBAperture(geo=brep_7)  # -> report, apertures; plug-in component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
aperturegroup = HBDynamicApertureGroup(apertures=aperture_2.apertures, name="Room_1_North")  # -> group_aps; plug-in component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
aperturegroup_2 = HBDynamicApertureGroup(apertures=aperture_3.apertures, name="Room_1_South")  # -> group_aps; plug-in component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
aperturegroup_3 = HBDynamicApertureGroup(apertures=aperture_4.apertures, name="Room_1_Skylight")  # -> group_aps; plug-in component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
aperturegroup_4 = HBDynamicApertureGroup(apertures=aperture_5.apertures, name="Room_2_North")  # -> group_aps; plug-in component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
aperturegroup_5 = HBDynamicApertureGroup(apertures=aperture_6.apertures, name="Room_2_Skylight")  # -> group_aps; plug-in component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
data = Data([aperturegroup, aperturegroup_2, aperturegroup_3, aperturegroup_4, aperturegroup_5])

# ----
# Model + Grids
panel_2 = Panel("sample_model_grid")
model = HBModel(rooms=flatten(bordershades.hb_objs), shades=flatten(shade.shades), name=panel_2)  # -> report, model; plug-in component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
gridrooms = HBSensorGridFromRooms(rooms=bordershades.hb_objs, grid_size="0.5")  # -> grid, points, mesh; plug-in component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
assigngridsviews = HBAssignGridsAndViews(model=model.model, grids=flatten(gridrooms.grid))  # -> model; plug-in component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
vizwiref = HBVisualizeWireframe(hb_objs=flatten(model.model))  # -> geo; plug-in component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

# ----
# Wea
panel_3 = Panel("https://energyplus-weather.s3.amazonaws.com/north_and_central_america_wmo_region_4/USA/MA/USA_MA_Boston-Logan.Intl.AP.725090_TMY3/USA_MA_Boston-Logan.Intl.AP.725090_TMY3.zip")
# Diffuse and Specular Transmission
# The diffuse and specular transmission of the blinds.
# The default assumes a diffuse transmission of 5%
# (0.05), while the specular transmission is practically
# zero, 0.1% (0.001).
downloadepw = LBDownloadWeather(weather_URL=panel_3)  # -> epw_file, stat_file, ddy_file; plug-in component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
wea = HBWeaFromEPW(epw_file=downloadepw.epw_file)  # -> wea; plug-in component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

# ----
# Aperture Groups: Automatic grouping
# When using automatic grouping make sure that _room_based_
# is True (default). The aperture will be grouped by orientation
# per room basis. If you have created the groups manually, you
# should not use the automatic method.
toggle = BooleanToggle(True)
autogroup = HBAutomaticApertureGroup(model=assigngridsviews, run=toggle)  # -> model; plug-in component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

# ----
# Run Recipe
toggle_2 = BooleanToggle(False)
leedopti = HBLEEDOptionI(model=autogroup, wea=wea, run=toggle_2)  # -> report, results, credit_summary, space_summary, dynamic_schedule, DA, direct_sun_hours, hourly_pct_above; plug-in component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

panel_4 = Panel(leedopti.space_summary)
panel_5 = Panel(leedopti.credit_summary)
daylightmetrics = HBAnnualDaylightMetrics(results=flatten(leedopti.results), dyn_sch=flatten(leedopti.dynamic_schedule))  # -> report, DA, cDA, UDI, UDI_low, UDI_up; plug-in component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

# ----
# Visualize Hourly Shading
# for Aperture Groups
swatch = ColourSwatch(SwatchColor=RGB(0, 255, 0))
panel_6 = Panel("""Shading Off
Shading On""")
legendparcategorized = LBLegendParametersCategorized(domain="0.5", colors=[swatch, ColourSwatch(SwatchColor=RGB(255, 0, 0))], categories=panel_6)  # -> leg_par; plug-in component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
hourlyplot = LBHourlyPlot(data=leedopti.dynamic_schedule, base_pt="50,0,0", legend_par=legendparcategorized)  # -> report, mesh, legend, borders, labels, title, vis_set; plug-in component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

# ----
# Compute sDA
sda = HBSpatialDaylightAutonomy(DA=daylightmetrics.DA, mesh=gridrooms.mesh)  # -> report, sDA, pass_fail; plug-in component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
sda_in_each_room = Panel(sda.sDA)

# ----
# Compute ASE
ase = HBAnnualSunlightExposure(results=leedopti.results)  # -> report, ASE, hrs_above; plug-in component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
ase_in_each_room = Panel(ase.ASE)

# ----
# Visualize Daylight Autonomy
mjoin = MeshJoin(Meshes=gridrooms.mesh)
data_2 = Data(flatten(leedopti.DA))
heatmap = LBSpatialHeatmap(values=data_2, mesh=mjoin, legend_title="%")  # -> mesh, legend, title, colors, legend_par, vis_set; plug-in component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
