# Grasshopper definition leed_ii.gh (Grasshopper 1.0.7)

# ---- group: Opaque Faces
geo = Geometry([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])
roomsolid = HBRoomFromSolid(geo=flatten(geo), name="TestRoom", conditioned=True)  # -> report, rooms; plug-in component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

# ---- group: Apertures
# Geometry Preparation
panel = Panel("g_material")
glassmod = HBGlassModifier(name=panel, trans="0.55")  # -> modifier; plug-in component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
brep = Brep([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])
aperture = HBAperture(geo=brep, rad_mod=glassmod)  # -> report, apertures; plug-in component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
addsubface = HBAddSubface(hb_obj=flatten(roomsolid.rooms), sub_faces=flatten(aperture.apertures))  # -> report, hb_obj, unmatched; plug-in component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
bordershades = HBExtrudedBorderShades(hb_objs=flatten(addsubface.hb_obj), depth="0.3")  # -> report, hb_objs; plug-in component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

# ---- group: Context!
brep_2 = Brep([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])
shade = HBShade(geo=brep_2)  # -> report, shades; plug-in component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

# ----
# Wea
panel_2 = Panel("https://energyplus-weather.s3.amazonaws.com/north_and_central_america_wmo_region_4/USA/MA/USA_MA_Boston-Logan.Intl.AP.725090_TMY3/USA_MA_Boston-Logan.Intl.AP.725090_TMY3.zip")
downloadepw = LBDownloadWeather(weather_URL=panel_2)  # -> epw_file, stat_file, ddy_file; plug-in component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
wea = HBWeaFromEPW(epw_file=downloadepw.epw_file)  # -> wea; plug-in component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

# ----
# Model + Grids
panel_3 = Panel("sample_model_grid")
model = HBModel(rooms=flatten(bordershades.hb_objs), shades=flatten(shade.shades), name=panel_3)  # -> report, model; plug-in component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
gridrooms = HBSensorGridFromRooms(rooms=bordershades.hb_objs, grid_size="0.5")  # -> grid, points, mesh; plug-in component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
assigngridsviews = HBAssignGridsAndViews(model=model.model, grids=flatten(gridrooms.grid))  # -> model; plug-in component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
vizwiref = HBVisualizeWireframe(hb_objs=flatten(model.model))  # -> geo; plug-in component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

# ----
# Run Recipe
toggle = BooleanToggle(False)
leedoptii = HBLEEDOptionII(model=assigngridsviews, wea=wea, run=toggle)  # -> report, credit_summary, space_summary, combined_compliance, illuminance_9am, illuminance_3pm, compliance_9am, compliance_3pm; plug-in component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

panel_4 = Panel(leedoptii.credit_summary)
panel_5 = Panel(leedoptii.space_summary)

# ----
# Visualize Compliance
swatch = ColourSwatch(SwatchColor=RGB(255, 0, 0))
panel_6 = Panel("""Fail
Pass""")
legendparcategorized = LBLegendParametersCategorized(domain="0.5", colors=[swatch, ColourSwatch(SwatchColor=RGB(0, 255, 0))], categories=panel_6)  # -> leg_par; plug-in component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
data = Data(flatten(leedoptii.combined_compliance))
mjoin = MeshJoin(Meshes=gridrooms.mesh)
heatmap = LBSpatialHeatmap(values=data, mesh=mjoin, legend_par=legendparcategorized)  # -> mesh, legend, title, colors, legend_par, vis_set; plug-in component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
