# Grasshopper definition viewbased.gh (Grasshopper 1.0.7)
# plug-ins: LadybugGrasshopper

# ----
# View
# Use these component to create views.
# You can create a view from either a Rhino
# viewport or from raw parameters descriving
# the view.
crv = Curve(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)
end = EndPoints(Curve=crv)  # -> Start, End
vec2pt = Vector2Pt(PointA=end.Start, PointB=end.End, Unitize=False)  # -> Vector, Length
vdisex = VectorDisplayEx(Point=end.Start, Vector=vec2pt.Vector, Colour=RGB(0, 0, 0), Width=2)
view = HBView(name="indoor view", position=end.Start, direction=vec2pt.Vector, view_type="1")  # -> view; plug-in component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
viewport = HBViewFromViewport(name="outdoor view", refresh=Button())  # -> view; plug-in component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

# ---- group: Context!
brep = Brep([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])
shade = HBShade(geo=brep)  # -> report, shades; plug-in component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

# ---- group: Opaque Faces
geo = Geometry([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])
roomsolid = HBRoomFromSolid(geo=flatten(geo), conditioned=True)  # -> report, rooms; plug-in component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

# ---- group: Apertures
# Geometry Preparation
panel = Panel("g_material")
glassmod = HBGlassModifier(name=panel, trans="0.55")  # -> modifier; plug-in component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
brep_2 = Brep([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])
aperture = HBAperture(geo=brep_2, rad_mod=glassmod)  # -> report, apertures; plug-in component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
addsubface = HBAddSubface(hb_obj=flatten(roomsolid.rooms), sub_faces=flatten(aperture.apertures))  # -> report, hb_obj, unmatched; plug-in component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
bordershades = HBExtrudedBorderShades(hb_objs=flatten(addsubface.hb_obj), depth="0.3")  # -> report, hb_objs; plug-in component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

# ----
# Sky
panel_2 = Panel("https://energyplus-weather.s3.amazonaws.com/north_and_central_america_wmo_region_4/USA/MA/USA_MA_Boston-Logan.Intl.AP.725090_TMY3/USA_MA_Boston-Logan.Intl.AP.725090_TMY3.zip")
downloadepw = LBDownloadWeather(weather_URL=panel_2)  # -> epw_file, stat_file, ddy_file; plug-in component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
number_slider = Slider(3, range=1..12)
number_slider_2 = Slider(21, range=1..31)
number_slider_3 = Slider(11, range=0..23)
importloc = LBImportLocation(epw_file=downloadepw.epw_file)  # -> location; plug-in component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
ciesky = HBCIEStandardSky(north="180", location=importloc, month=number_slider, day=number_slider_2, hour=number_slider_3, type=0)  # -> sky; plug-in component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

# ----
# Model
panel_3 = Panel("hb_sample_model_view")
model = HBModel(rooms=flatten(bordershades.hb_objs), shades=flatten(shade.shades), name=panel_3)  # -> report, model; plug-in component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
assigngridsviews = HBAssignGridsAndViews(model=model.model, views=flatten(view))  # -> model; plug-in component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
vizwiref = HBVisualizeWireframe(hb_objs=flatten(model.model))  # -> geo; plug-in component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

pitview = HBPointInTimeViewBased(model=assigngridsviews, sky=ciesky, run=Toggle(False))  # -> report, results; plug-in component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

falsecolor = HBFalseColor(hdr=pitview.results, max="2500", legend_height="650", legend_width="140", mask=Toggle(True))  # -> hdr; plug-in component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

glare = HBGlarePostprocess(hdr=pitview.results)  # -> DGP, category, glare_indices, check_hdr; plug-in component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

hoy = LBCalculateHOY(month=number_slider, day=number_slider_2, hour=number_slider_3)  # -> flatten(hoy), flatten(doy), flatten(date); plug-in component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
join = TextJoin(Text=["Northeast Corner", hoy.date, glare.category])
adjusthdr = HBAdjustHDR(hdr=pitview.results, adj_expos=Toggle(True), label=join)  # -> hdr; plug-in component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

imageviewer = LBImageViewer(ImagePath_=falsecolor, _scale_=1, DisableClickable=False, SaveImgWithCoords=False, scale=1)  # -> ImagePath, Values, GIF
imageviewer_2 = LBImageViewer(ImagePath_=adjusthdr, _scale_=1, DisableClickable=False, SaveImgWithCoords=False, scale=1)  # -> ImagePath, Values, GIF
panel_4 = Panel([glare.DGP, glare.category])
