# Grasshopper definition water_cube_example.gh (Grasshopper 1.0.7)
# plug-ins: LadybugGrasshopper

panel = Panel("""void texfunc wavy
6 wave_x wave_y wave_z wave.cal -s .05
0
1 .25
wavy glass water
0
0
3 0.51 0.62 0.72""")
# Be sure to copy the wave.cal file into the radiance/lib folder
panel_2 = Panel("4")
box = DomainBox(Base=PlaneXY(0, 0, 0), X=panel_2, Y="12", Z="3")
python = GhPythonScript(rad_str=panel)  # -> rad_mod
# ---------- python: Python ----------
from honeybee_radiance.modifier.material.glass import Glass
rad_mod = Glass.from_string(rad_str)
# ---------- end python ----------
face = HBFace(geo=box, name="Water Cube", rad_mod=python)  # -> report, faces; plug-in component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
checkscene = HBCheckScene(hb_objs=flatten(face.faces), run=Toggle(False))  # -> report, hdr; plug-in component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
imageviewer = LBImageViewer(ImagePath_=checkscene.hdr, _scale_=1, DisableClickable=False, SaveImgWithCoords=False, scale=1)  # -> ImagePath, Values, GIF
