# Grasshopper definition model_with_shade_mesh.gh (Grasshopper 1.0.7)

# ----
# Model of a Tiny House
panel = Panel("Picture Window")
geo = Geometry(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)
geo_2 = Geometry(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)
geo_3 = Geometry(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)
geo_4 = Geometry([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])
geo_5 = Geometry(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)
aperture = HBAperture(geo=geo_2, name=panel)  # -> report, apertures; plug-in component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
shade = HBShade(geo=geo, name="Overhang")  # -> report, shades; plug-in component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
aperture_2 = HBAperture(geo=geo_4)  # -> report, apertures; plug-in component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
face = HBFace(geo=geo_3, name="Tiny House Face")  # -> report, faces; plug-in component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
door = HBDoor(geo=geo_5, name="Front Door")  # -> report, doors; plug-in component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
addshade = HBAddShade(hb_obj=aperture.apertures, out_shades=flatten(shade.shades))  # -> hb_obj; plug-in component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
addsubface = HBAddSubface(hb_obj=flatten(face.faces), sub_faces=flatten([addshade, door.doors, aperture_2.apertures]))  # -> report, hb_obj, unmatched; plug-in component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
geo_6 = Geometry(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)
geo_7 = Geometry(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)
shade_2 = HBShade(geo=geo_7)  # -> report, shades; plug-in component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
shade_3 = HBShade(geo=geo_6)  # -> report, shades; plug-in component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
room = HBRoom(faces=flatten(addsubface.hb_obj), name="Tiny House", conditioned=Toggle(True))  # -> report, room; plug-in component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
addshade_2 = HBAddShade(hb_obj=room.room, out_shades=flatten(shade_2.shades), in_shades=flatten(shade_3.shades))  # -> hb_obj; plug-in component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
tiny_house_room = Data(flatten(addshade_2))

# ----
# Context Shade
panel_2 = Panel("40, 15, 4")
msphere = MeshSphere(Base=panel_2, Radius="2", UCount=10, VCount=20)
shade_4 = HBShade(geo=msphere, name="Tree")  # -> report, shades; plug-in component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

model = HBModel(rooms=flatten(tiny_house_room), shades=flatten(shade_4.shades))  # -> report, model; plug-in component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
vizbytype = HBVisualizeByType(hb_objs=model.model)  # -> walls, interior_walls, roofs, ceilings, exterior_floors, interior_floors, air_walls, apertures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; plug-in component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
deconstructmodel = HBDeconstructModel(model=model.model)  # -> rooms, faces, apertures, doors, shades; plug-in component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
panel_3 = Panel(deconstructmodel.shades)
